# Grasshopper definition 2019-07-09_1-2_Subdivision-Mesh.gh (Grasshopper 1.0.7)
# plug-ins: Karamba, Pufferfish, EleFront, Bifocals, Weaverbird, Kangaroo2 Components

# ----
# INPUT
# 1. Object (as Mesh)
mesh = Mesh(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)

# ----
# Divisions that work (except non-manifold): Outer boundary:	90
# Inner boundary:	24
# Extracting boundaries, projecting them on XY plane and making divisions for Delaunay triangulation
# The definition recognizes the longest closed curve as the boundary curve, while the other curves are seen as opening curves
divisions_inner_boundaries = Slider(24, range=0..100)
# NOTE:: This definition is created as part of the master thesis 'Subdivision and approximation of free-form steel structures' of Thomas van Loon.
# 
# This definition corresponds to section 7.1 in the thesis report.
divisions_outer_boundary = Slider(90, range=0..100)
medges = MeshEdges(Mesh=mesh)  # -> NakedEdges, InteriorEdges, NonManifoldEdges
join = JoinCurves(Curves=medges.NakedEdges, Preserve=False)
explode = Explode(Curve=join, Recursive=True)  # -> Segments, Vertices
intcrv = Interpolate(Vertices=explode.Vertices, Degree=3, Periodic=False, KnotStyle=1)  # -> flatten(Curve), Length, Domain
constructplane = ConstructPlane(C=mesh, B=Slider(0, range=0..1))
sort = SortList(Keys=intcrv.Curve, ValuesA=intcrv.Curve)  # -> Keys, ValuesA
item = ListItem(List=sort.ValuesA, Index="-1", Wrap=True)
cull_i = CullIndex(List=sort.ValuesA, Indices="-1", Wrap=True)
project = Project(Geometry=item, Plane=constructplane)  # -> Geometry, Transform
project_2 = Project(Geometry=cull_i, Plane=constructplane)  # -> Geometry, Transform
divide = DivideCurve(Curve=project.Geometry, Count=divisions_outer_boundary, Kinks=False)  # -> Points, Tangents, Parameters
divide_2 = DivideCurve(Curve=project_2.Geometry, Count=divisions_inner_boundaries, Kinks=False)  # -> Points, Tangents, Parameters

# ----
# OUTPUT / INPUT
# 1. Boundary curve (projected in 2D plane)
# 2. Opening curves (projected in 2D plane)
# 3. Points for Delaunay triangulation
# 4. Working plane
opening_curves = Curve(flatten(project_2.Geometry))
pln = Plane(flatten(constructplane))
outer_boundary_curve = Curve(flatten(project.Geometry))
division_points_of_boundary_curves = Point(flatten([divide_2.Points, divide.Points]))

# ---- group: Delaunay triangulation (meshing)
# Delaunay meshing based on divisions of edge curves and culling all faces outside of surface domain
del = DelaunayMesh(Points=flatten(division_points_of_boundary_curves), Plane=PlaneXY(0, 0, 0))
facen = FaceNormals(Mesh=del)  # -> Centers, Normals
incurve = PointInCurve(Point=facen.Centers, Curve=outer_boundary_curve)  # -> Relationship, Point
eval = Evaluate(F="if(x=0, True, False)", x=incurve.Relationship)
cullf = CullFaces(Mesh=del, Pattern=eval)
# PSEUDOCODE: - Construct a Delaunay mesh from points
# - Retrieve the centerpoints of the faces
# - For each center check if it is located within boundary curve
# - Cull faces that have a center outside the boundary curve
# - For each remaining face check if center is located inside the opening curves
# - Cull faces that have a center inside one of the opening curves
facen_2 = FaceNormals(Mesh=cullf)  # -> Centers, Normals
incurves = PointInCurves(Point=facen_2.Centers, Curves=opening_curves)  # -> Relationship, Index, Point
eval_2 = Evaluate(F="if(x=2, True, False)", x=incurves.Relationship)
cullf_2 = CullFaces(Mesh=cullf, Pattern=eval_2)

# ----
# OUTPUT / INPUT
# 1. Delaunay mesh of projected object
# 2. Boundary curve (projected in 2D plane)
# 3. Opening curves (projected in 2D plane)
delaunay_mesh = Mesh(cullf_2)
outer_boundary_cuve = Curve(outer_boundary_curve)
opening_curves_2 = Curve(opening_curves)

# ----
# Connecting the circumcentres of each Delaunay face with the one of its adjacent face, in order to construct the medial Axis.
m_conface = ConnectedFaces(M=delaunay_mesh)  # -> out, G, A, simplify(T), P
# ---------- m_conface: VB ----------
    Component.Params.Input(0).Name = "Mesh"
    Component.Params.Input(0).Description = "Open or closed mesh"
    Component.Params.Input(1).Name = "Connected Domain"
    Component.Params.Input(1).Description = "The domain that describes the range of connected faces to be tested against"

    Component.Params.Output(1).Name = "Preview Mesh"
    Component.Params.Output(1).Description = "A greyscale preview mesh reflecting the range of values"
    Component.Params.Output(2).Name = "Connections"
    Component.Params.Output(2).Description = "The number of faces connected to each face of the mesh"
    Component.Params.Output(3).Name = "Topology"
    Component.Params.Output(3).Description = "The list of index values connected to the sample point"
    Component.Params.Output(4).Name = "Pattern"
    Component.Params.Output(4).Description = "If the R input is used, the status of each sample point relative to the provided range (0 = Below, 1 = Within, 2 = Above)"

    If M IsNot Nothing Then
      Dim i,j,k,s As Integer

      Dim iP As Grasshopper.Kernel.IGH_Param = Component.Params.Input(0)
      Dim cP As Grasshopper.Kernel.Data.IGH_Structure = iP.VolatileData

      Dim mf As Rhino.Geometry.Collections.MeshFaceList = Nothing
      Dim mfn As Rhino.Geometry.Collections.MeshFaceNormalList = Nothing
      Dim mv As Rhino.Geometry.Collections.MeshVertexList = Nothing
      Dim mtv As Rhino.Geometry.Collections.MeshTopologyVertexList = Nothing
      Dim mte As Rhino.Geometry.Collections.MeshTopologyEdgeList = Nothing
      Dim mn As Rhino.Geometry.Collections.MeshVertexNormalList = Nothing
      Dim mc As Rhino.Geometry.Collections.MeshVertexColorList = Nothing

      mf = m.Faces
      mfn = m.FaceNormals
      mv = m.Vertices
      mtv = m.TopologyVertices
      mte = m.TopologyEdges
      mn = m.Normals
      mc = m.VertexColors

      Dim arrK As New list(Of Integer)
      Dim treeK As New datatree(Of Integer)
      Dim oc As New list(Of color)
      Dim tv,tmin,tmax As Integer
      Dim arrPat As New list(Of Integer)

      Dim mfo As New list(Of MeshFace)
      Dim mvo As New list(Of point3d)

      For i = 0 To mf.count() - 1 Step 1
        Dim tcv() As Integer

        tcv = mf.AdjacentFaces(i)
        s = mvo.count()

        k = (ubound(tcv) + 1)

        If mf.item(i).isquad() Then
          mvo.add(mv.item(mf.item(i).A))
          mvo.add(mv.item(mf.item(i).B))
          mvo.add(mv.item(mf.item(i).C))
          mvo.add(mv.item(mf.item(i).D))
          mfo.add(New meshface(s, s + 1, s + 2, s + 3))
        Else
          mvo.add(mv.item(mf.item(i).A))
          mvo.add(mv.item(mf.item(i).B))
          mvo.add(mv.item(mf.item(i).C))
          mfo.add(New meshface(s, s + 1, s + 2))
        End If

        Dim tang,ang, aMin, aMax As New Double
        For j = 0 To ubound(tcv) Step 1
          treeK.add(tcv(j), cp.Path(Component.RunCount - 1).AppendElement(i))
        Next

        If k < Tmin Then Tmin = k
        If i = 0 Then Tmax = k Else If k > Tmax Then Tmax = k
        arrK.add(k)
      Next

      If R = Nothing Then
        R.t0 = Tmin
        R.t1 = Tmax
      End If

      For i = 0 To mf.count() - 1 Step 1
        If mf.item(i).isquad() Then k = 3 Else k = 2
        If arrK.item(i) < R.T0 Then
          For j = 0 To k Step 1
            oc.add(color.FromArgb(0, 0, 255))
          Next
          arrPat.add(0)
        ElseIf ((arrK.item(i) > R.T1) Or ((R.t0 = 0) And (R.t1 = 0))) Then
          For j = 0 To k Step 1
            oc.add(color.FromArgb(255, 0, 0))
          Next
          arrPat.add(2)
        Else
          For j = 0 To k Step 1
            tv = math.Floor((arrK.item(i) - R.T0) / (R.t1 - R.t0) * 255)
            oc.add(color.FromArgb(tv, tv, tv))
          Next
          arrPat.add(1)
        End If
      Next
      Dim mo As New mesh
      mo.vertices.AddVertices(mvo.toarray())
      mo.Faces.AddFaces(mfo.toarray())
      mo.VertexColors.AppendColors(oc.toarray())

      G = mo
      A = arrK
      P = arrPat
      T = treeK
    End If
# ---------- end m_conface ----------
demesh = DeconstructMesh(Mesh=delaunay_mesh)  # -> Vertices, Faces, Colours, Normals
facec = FaceCircles(Mesh=delaunay_mesh)  # -> Centers, Ratio
item_2 = ListItem(List=facec.Centers, Index=m_conface.T, Wrap=True)  # -> simplify(Item)
eval_3 = Evaluate(F="if(x=1, True, False)", x=m_conface.A)
cull = CullPattern(List=demesh.Faces, CullPattern=eval_3)
cull_2 = CullPattern(List=facec.Centers, CullPattern=eval_3)  # -> graft(List)
ln = Line(StartPoint=simplify(graft(facec.Centers)), EndPoint=item_2)
deface = DeconstructFace(Face=graft(cull))  # -> CornerA, CornerB, CornerC, CornerD
merge = Merge(Data1=deface.CornerA, Data2=deface.CornerB, Data3=deface.CornerC)
item_3 = ListItem(List=demesh.Vertices, Index=merge, Wrap=True)  # -> simplify(Item)
incurve_2 = PointInCurve(Point=item_3, Curve=outer_boundary_cuve)  # -> Relationship, Point
eval_4 = Evaluate(F="if(x=1, True, False)", x=incurve_2.Relationship)
cull_3 = CullPattern(List=item_3, CullPattern=eval_4)
ln_2 = Line(StartPoint=cull_3, EndPoint=cull_2)  # -> simplify(Line)
len = Length(Curve=ln_2)
hilo = HighestLowestNumbers(Numbers=len)  # -> Highest, Lowest
equals = Equality(FirstNumber=hilo.Highest, SecondNumber=len)  # -> Equality, Inequality
cull_4 = CullPattern(List=ln_2, CullPattern=equals.Equality)
merge_2 = Merge(Data1=ln, Data2=cull_4)  # -> flatten(Result)
rdlines = RemoveDuplicateLinesKaramba3D(Line=merge_2, LimitDistance=0.005)  # -> OutLine, Info, Indexes
eval_5 = Evaluate(F="if(x=3, True, False)", x=m_conface.A)
join_2 = JoinCurves(Curves=rdlines.OutLine, Preserve=False)  # -> reparameterize(simplify(graft(Curves)))
cull_5 = CullPattern(List=facec.Centers, CullPattern=eval_5)  # -> flatten(List)

# ----
# Joining and shattering curves at the intersection points.
crv_cp = CurveClosestPoint(Point=cull_5, Curve=join_2)  # -> Point, Parameter, Distance
hilo_2 = HighestLowestNumbers(Numbers=crv_cp.Distance)  # -> Highest, Lowest
equals_2 = Equality(FirstNumber=crv_cp.Distance, SecondNumber=hilo_2.Lowest)  # -> Equality, Inequality
cull_6 = CullPattern(List=crv_cp.Parameter, CullPattern=equals_2.Equality)  # -> simplify(List)
shatter = Shatter(Curve=join_2, Parameters=cull_6)  # -> reparameterize(flatten(Segments))

crv_cp_2 = CurveClosestPoint(Point=cull_5, Curve=simplify(graft(shatter)))  # -> Point, Parameter, Distance
hilo_3 = HighestLowestNumbers(Numbers=crv_cp_2.Distance)  # -> Highest, Lowest
equals_3 = Equality(FirstNumber=crv_cp_2.Distance, SecondNumber=hilo_3.Lowest)  # -> Equality, Inequality
cull_7 = CullPattern(List=crv_cp_2.Parameter, CullPattern=equals_3.Equality)
shatter_2 = Shatter(Curve=simplify(graft(shatter)), Parameters=cull_7)  # -> flatten(Segments)

# ----
# Culling the S-C branches in order to extract the S-S branches necessary for the topological skeleton.
graft = GraftTree(Tree=shatter_2, IncludeEmptyLists=True, IncludeNullItems=True)  # -> simplify(Tree)
end = EndPoints(Curve=graft)  # -> Start, End
incurve_3 = PointInCurve(Point=end.Start, Curve=outer_boundary_cuve)  # -> Relationship, Point
incurve_4 = PointInCurve(Point=end.End, Curve=outer_boundary_cuve)  # -> Relationship, Point
eval_6 = Evaluate(F="if(x=1, False, True)", x=incurve_3.Relationship)
eval_7 = Evaluate(F="if(x=1, False, True)", x=incurve_4.Relationship)
merge_3 = Merge(Data1=eval_6, Data2=eval_7)
avr = Average(Input=merge_3)
eval_8 = Evaluate(F="if(x≠1, False, True)", x=avr)  # -> flatten(r)
cull_8 = CullPattern(List=shatter_2, CullPattern=eval_8)

# ----
# OUTPUT / INPUT
# 1. Delaunay mesh of projected object
# 2. Boundary curve (projected in 2D plane)
# 3. Opening curves (projected in 2D plane)
# 4. Curves of the Medial Axis (S-S branches)
delaunay_mesh_2 = Mesh(delaunay_mesh)
outer_boundary_cuve_2 = Curve(outer_boundary_cuve)
opening_curves_3 = Curve(opening_curves_2)
medial_axis = Curve(flatten(cull_8))

# ---- group: Grafting S-B branches
m_conface_2 = ConnectedFaces(M=delaunay_mesh_2)  # -> out, G, A, T, P; same code as m_conface
demesh_2 = DeconstructMesh(Mesh=m_conface_2.G)  # -> Vertices, Faces, Colours, Normals
facec_2 = FaceCircles(Mesh=m_conface_2.G)  # -> Centers, Ratio
# PSEUDOCODE: Desired result:
# The S-B branches to finish the topological skeleton of the shape.
# 
# - Use the Mesh+ component 'Connected Faces' to retrieve the mesh topology of the Delaunay Mesh, e.g. face connectivity.
# - Per face, retrieve the number of connections using this component.
# - If the number of connections is 3 (e.g. the face is a singular face), return True, else return False.
# - Cull the mesh faces using the constructed pattern.
# - Retrieve the face vertices of each singular face.
# 
# - Retrieve the circumcentres of each face in the Delaunay Mesh.
# - Cull them using the same pattern in order to select only the circumcentres of the singular faces in the mesh.
# 
# - For each singular face, interpolate a line from the circumcenter to each of the face vertices.
# 
# Result:
# The lines to close off the topological skeleton of the shape, e.g. the S-B branches.
eval_9 = Evaluate(F="if(x=3, True, False)", x=m_conface_2.A)
cull_9 = CullPattern(List=demesh_2.Faces, CullPattern=eval_9)
pt = Point(facec_2.Centers)
deface_2 = DeconstructFace(Face=cull_9)  # -> CornerA, CornerB, CornerC, CornerD
item_4 = ListItem(List=demesh_2.Vertices, Index=deface_2.CornerB, Wrap=True)  # -> simplify(graft(Item))
item_5 = ListItem(List=demesh_2.Vertices, Index=deface_2.CornerA, Wrap=True)  # -> simplify(graft(Item))
item_6 = ListItem(List=demesh_2.Vertices, Index=deface_2.CornerC, Wrap=True)  # -> simplify(graft(Item))
cull_10 = CullPattern(List=pt, CullPattern=eval_9)
pt_2 = Point(graft(cull_10))
pt_3 = Point([item_5, item_4, item_6])
panel = Panel("Grafting S-B branches")
ln_3 = Line(StartPoint=pt_3, EndPoint=pt_2)

# ----
# OUTPUT / INPUT
# 1. Boundary curve (projected in 2D plane)
# 2. Opening curves (projected in 2D plane)
# 3. Curves of the Medial Axis (S-S branches)
# 4. Lines of the Medial Axis (S-B branches)
outer_boundary_cuve_3 = Curve(flatten(outer_boundary_cuve_2))
opening_curves_4 = Curve(flatten(opening_curves_3))
medial_axis_s_s = Curve(flatten(medial_axis))
medial_axis_s_b = Curve(flatten(ln_3))

# ----
# Finding edges of each panel, shattering edges on correct corner points
# Fixing bugs in shattering
crv = Curve(medial_axis_s_b)
crv_2 = Curve(outer_boundary_cuve_3)
crv_3 = Curve(opening_curves_4)
crv_4 = Curve(medial_axis_s_s)
ccx = CurveCurve(CurveA=reparameterize(simplify(graft(crv_3))), CurveB=crv)  # -> Points, ParamsA, ParamsB
ccx_2 = CurveCurve(CurveA=reparameterize(simplify(graft(crv_2))), CurveB=crv)  # -> Points, ParamsA, ParamsB
ccx_3 = CurveCurve(CurveA=reparameterize(simplify(graft(crv_4))), CurveB=crv)  # -> Points, ParamsA, ParamsB
pshift = ShiftPaths(Data=ccx_2.ParamsA, Offset=-1)
pshift_2 = ShiftPaths(Data=ccx.ParamsA, Offset=-1)
pshift_3 = ShiftPaths(Data=ccx_3.ParamsA, Offset=-1)
shatter_3 = Shatter(Curve=reparameterize(simplify(graft(crv_2))), Parameters=pshift)  # -> flatten(Segments)
shatter_4 = Shatter(Curve=reparameterize(simplify(graft(crv_3))), Parameters=pshift_2)  # -> flatten(Segments)
# PSEUDOCODE: Desired result:
# All curves shattered at the intersection at each corner of an area. This would leave us with al edges per area organized in seperate branches.
# 
# - Retrieve the boundary curve(1), opening curves(2), curves of the Medial Axis (S-S branches)(3).
# - Retrieve the lines of the Medial Axis (S-B branches)(4).
# - For each (1), (2) and (3), use the curve|curve intersection component to find the curve parameters at the intersection points with (4).
# - Shatter (1), (2) and (3) at the parameters found in the previous step.
# - Merge the shattered curves of (1), (2), (3) and the lines of (4) alltogether to the topological skeleton of the shape in one branch.
# 
# - Create a Boundary Surface between the boundary curves and the opening curve.
# - Split this surface using all curves of the topologival skeleton.
# 
# Intermediate result:
# Surfaces representing each area in the topological skeleton.
# 
# - Retrieve the edges of each surface using the Brep Edge component.
# - Join all edges into one closed curve.
# - Use the curve|curve intersection tool to find the parameters on the closed curve at the intersection point with the lines of the S-B branches.
# - Shatter the closed curves at these parameters.
# 
# Result:
# All curves shattered at the intersection at each corner of an area. All edges per area organized in a seperate branch.
shatter_5 = Shatter(Curve=reparameterize(simplify(graft(crv_4))), Parameters=pshift_3)  # -> flatten(Segments)
merge_4 = Merge(Data1=shatter_3, Data2=shatter_5, Data3=shatter_4, Data4=crv)  # -> flatten(Result)
boundary = BoundarySurfaces(Edges=flatten([crv_2, crv_3]))
srfsplit = SurfaceSplit(Surface=boundary, Curves=merge_4)
edges = BrepEdges(Brep=srfsplit)  # -> simplify(Naked), Interior, NonManifold
merge_5 = Merge(Data1=shatter_3, Data2=shatter_5, Data3=shatter_4)  # -> flatten(Result)
crv_5 = Curve(crv)
join_3 = JoinCurves(Curves=edges.Naked, Preserve=False)  # -> reparameterize(simplify(Curves))
ccx_4 = CurveCurve(CurveA=simplify(graft(merge_5)), CurveB=crv_5)  # -> flatten(Points), ParamsA, ParamsB
cullpt = CullDuplicates(Points=ccx_4.Points, Tolerance=0.1, CullMode=3)  # -> Points, Indices, Valence
crv_cp_3 = CurveClosestPoint(Point=flatten(cullpt.Points), Curve=reparameterize(join_3))  # -> Point, Parameter, Distance
# PSEUDOCODE [BUGFIX]: Desired result:
# The edges of each area should have a count of either 3 or 4, depending on whether it is a triangular or quadrangular area. However, the model also include areas which have 3 edges, while they should have 4. This ‘module’ fixes these edges.
# 
# - The input is the edges of each area organised in a separate branch per area.
# - Retrieve the list length of each branch.
# - If list length is 4, return False, else return True.
# - Cull the branches using this pattern, to retrieve the branches with a list length of 3.
# - Also cull the branches using the inverse pattern, this will be used to later merge with the fixed ones.
# 
# Intermediate result:
# The branches left consist out of lines, polylines and planar curves. The problem with the shattering lies in the planar curves.
# 
# - Use the Filter Type component to filter all lines. Retrieve the Boolean pattern for Null items using the Null item component.
# - Cull out the Line-types using this pattern.
# - Again use the Filter Type component, but this time to filter all polylines. Retrieve the Boolean pattern for Null items using the Null item component.
# - Cull out the Polyline-types using this pattern, so that only the planar curves are left in each branch.
# - Explode the curves so that the curves of each quadrangular area are exploded into smaller segments, but the curves of the triangular zones will remain 1 segment.
# - Merge the curves again with the previously culled lines and polylines.
# 
# Intermediate result:
# The branches should now consist out of either 3 segments (triangular areas) and 4 segments (quadrangular areas). However, if a branch with another amount of segments arose (which is the case), another fix should be added. The problem lies again with the planar curves.
# 
# - Retrieve the list length of each branch.
# - If list length is either 3 or 4, return False, else return True.
# - Cull the branches using this pattern.
# - Also cull the branches using the inverse pattern, this will be used to later merge with the fixed ones.
# - Use the Filter Type component to filter all lines. Retrieve the Boolean pattern for Null items using the Null item component.
# - Cull out the Line-types using this pattern.
# - Again use the Filter Type component, but this time to filter all polylines. Retrieve the Boolean pattern for Null items using the Null item component.
# - Cull out the Polyline-types using this pattern, so that only the planar curves are left in each branch.
# - Join the curve segments into one planar curve.
# - Merge this curve with the previously culled lines and polylines.
# - Merge the modified branches with all the other branches.
# 
# Intermediate result:
# Branches are almost fixed, the only problem left are some (almost) zero length lines.
# 
# - For each branch, retrieve the length of each line, polyline or curve.
# - If the length of a line, polyline or curve is smaller than 0.010 meter, cull the line, polyline or curve.
# 
# Result:
# The fixed edges of each area organized in branches per area.
panel_2 = Panel("0.001")
smaller = SmallerThan(FirstNumber=crv_cp_3.Distance, SecondNumber=panel_2)  # -> SmallerThan, OrEqualTo
cull_11 = CullPattern(List=crv_cp_3.Parameter, CullPattern=smaller.OrEqualTo)
shatter_6 = Shatter(Curve=reparameterize(join_3), Parameters=cull_11)  # -> simplify(Segments)
bug_fix = BUGFIX(relay=shatter_6)

# ----
# Selecting branches to be modified
crv_6 = Curve(opening_curves_4)
crv_7 = Curve(bug_fix)
eval_10 = EvaluateCurve(Curve=reparameterize(crv_7), Parameter="0.5")  # -> Point, Tangent, Angle
incurves_2 = PointInCurves(Point=eval_10.Point, Curves=crv_6)  # -> Relationship, Index, Point
item_7 = ListItem(List=crv_6, Index=incurves_2.Index, Wrap=False)
sort_2 = SortList(Keys=item_7, ValuesA=item_7)  # -> Keys, ValuesA
item_8 = ListItem(List=sort_2.ValuesA, Index="-1", Wrap=True)
equals_4 = Equality(FirstNumber=simplify(graft(crv_6)), SecondNumber=flatten(item_8))  # -> Equality, Inequality
tstat = TreeStatistics(Tree=crv_7)  # -> flatten(Paths), Length, Count
cull_12 = CullPattern(List=tstat.Paths, CullPattern=equals_4.Equality)
cluster = Cluster(T=cull_12)
panel_3 = Panel(cull_12)
python = GhPythonScript(main_list=crv_7, desired_paths=cluster)  # -> out, selection; inputs main_list: tree of Curve, desired_paths: tree of Int32
# ---------- python: Python ----------
__author__ = "thoma"
__version__ = "2019.04.24"

import rhinoscriptsyntax as rs
import System.Object as so
import Grasshopper.DataTree as dt
import Grasshopper.Kernel.Data.GH_Path as ghp

####    CREATING DEFINITIONS

#Converting a Grasshopper dataTree to a nested list
def dataTreeToList(list):
    theList = []
    for i in range(list.BranchCount ):
        thisListPart = []
        thisBranch = list.Branch(i)
        for j in range(len(thisBranch)):
            thisListPart.append( thisBranch[j] )
        theList.append(thisListPart)
    return theList

#Converting a nested list back to a Grasshopper dataTree
def ListToDataTree(list):
    dataTree = dt[so]()
    for i, listItem in enumerate(list):
        for j, item in enumerate(listItem):
            p = ghp(i, j)
            try: dataTree.AddRange(item, p)
            except: dataTree.Add(item, p)
    return dataTree

#Select the desired data paths and organise in a nested list
def SelectPaths(paths, mainlist):
    dlist = []
    for elem in paths:
        path_nr = []
        for int in elem:
            path_nr.append(mainlist[int])
        dlist.append(path_nr)
    return dlist

####    IMPORTING GRASSHOPPER DATA AND OBJECTS
mlist = dataTreeToList(main_list)
dpaths = dataTreeToList(desired_paths) #AS INTEGER, NO "{ }"

####    MAIN CODE
selection = SelectPaths(dpaths, mlist)
selection = ListToDataTree(selection)
# ---------- end python ----------
tstat_2 = TreeStatistics(Tree=python.selection)  # -> Paths, Length, Count
replace = ReplacePaths(Data=python.selection, Search=tstat_2.Paths, Replace=flatten(cull_12))

# ----
# Split the selected branches from boundary edge
panel_4 = Panel("0.5")
eval_11 = EvaluateCurve(Curve=reparameterize(replace), Parameter=panel_4)  # -> Point, Tangent, Angle
incurves_3 = PointInCurves(Point=eval_11.Point, Curves=crv_6)  # -> Relationship, Index, Point
eval_12 = Evaluate(F="if(x=1, True, False)", x=incurves_3.Relationship)
cull_13 = CullPattern(List=replace, CullPattern=invert(eval_12))
cull_14 = CullPattern(List=replace, CullPattern=eval_12)
cluster_2 = Cluster_2(relay_2=cull_14, relay=cull_13)  # -> crv_bound, L, L_2
edge_length_threshold = Slider(3.5, range=0..10)
crv_8 = Curve(cluster_2.crv_bound)
crv_9 = Curve(cluster_2.L)
crv_10 = Curve(cluster_2.L_2)
len_2 = Length(Curve=crv_9)
eval_13 = Evaluate(F="if(x≤y, False, True)", x=len_2, y=edge_length_threshold)  # -> flatten(r)
tstat_3 = TreeStatistics(Tree=len_2)  # -> Paths, Length, Count
cull_15 = CullPattern(List=tstat_3.Paths, CullPattern=eval_13)
branch = TreeBranch(Tree=crv_10, Path=cull_15, MaintainPaths=True)
branch_2 = TreeBranch(Tree=crv_9, Path=cull_15, MaintainPaths=True)
branch_3 = TreeBranch(Tree=crv_8, Path=cull_15, MaintainPaths=True)
number_slider = Slider(7, range=1..10)
divide_3 = DivideCurve(Curve=branch_3, Count=number_slider, Kinks=False)  # -> Points, Tangents, Parameters
divide_4 = DivideCurve(Curve=branch_2, Count=number_slider, Kinks=False)  # -> Points, Tangents, Parameters
len_3 = Length(Curve=[branch_3, branch_2])
ln_4 = Line(StartPoint=divide_3.Points, EndPoint=reverse(divide_4.Points))
panel_5 = Panel("""0
-1""")
division = Division(A=len_3, B=number_slider)
new_edge_length = Panel(division)
cull_i_2 = CullIndex(List=ln_4, Indices=panel_5, Wrap=True)  # -> simplify(List)
boundary_2 = BoundarySurfaces(Edges=replace)
crv_11 = Curve(cull_i_2)
srfsplit_2 = SurfaceSplit(Surface=boundary_2, Curves=crv_11)  # -> simplify(Fragments)
cluster_3 = Cluster_3(int=cluster, path=tstat.Paths)
edges_2 = BrepEdges(Brep=srfsplit_2)  # -> Naked, Interior, NonManifold
join_4 = JoinCurves(Curves=edges_2.Naked, Preserve=False)  # -> reparameterize(simplify(Curves))
branch_4 = TreeBranch(Tree=crv_7, Path=cluster_3, MaintainPaths=True)
end_2 = EndPoints(Curve=[cull_i_2, crv_10])  # -> Start, End
accuracy = Slider(0.05, range=0..0.1)
crv_cp_4 = CurveClosestPoint(Point=flatten([end_2.Start, end_2.End]), Curve=reparameterize(join_4))  # -> Point, Parameter, Distance
eval_14 = Evaluate(F="if(x≤y, True, False)", x=crv_cp_4.Distance, y=accuracy)
cull_16 = CullPattern(List=crv_cp_4.Parameter, CullPattern=eval_14)
shatter_7 = Shatter(Curve=reparameterize(join_4), Parameters=cull_16)  # -> simplify(Segments)
merge_6 = Merge(Data1=shatter_7, Data2=branch_4)

# ----
# Selecting adjacent branches to be modified as well
crv_12 = Curve(flatten(cluster_2.L))
crv_13 = Curve(merge_6)
join_5 = JoinCurves(Curves=crv_12, Preserve=False)
eval_15 = EvaluateCurve(Curve=reparameterize(crv_13), Parameter="0.5")  # -> Point, Tangent, Angle
incurves_4 = PointInCurves(Point=eval_15.Point, Curves=join_5)  # -> Relationship, Index, Point
item_9 = ListItem(List=join_5, Index=incurves_4.Index, Wrap=False)
sort_3 = SortList(Keys=item_9, ValuesA=item_9)  # -> Keys, ValuesA
item_10 = ListItem(List=sort_3.ValuesA, Index="-1", Wrap=True)
# PSEUDOCODE: Desired result:
# In order to prevent manifold faces to arise in the meshing, the faces near an opening should be splitted if there are 2 or less regions around an opening.
# 
# - Retrieve all edge curves (1) of each region, sorted in a tree structure where each branch represents a different region.
# - Retrieve all opening curves (1) as well, in a flat list.
# 
# - For all edge curves (1), construct a point in the middle of the curve (Evaluate Curve at parameter 0.5).
# - For each point, check whether it is located on one of the opening curves (2) (Point in curves component)
# - Retrieve the index of the first region of the curve that contains a point. NOTE: There will never be a point inside the opening curves, only on the curve or outside the curve. If a point is not in- and on the curve it gets and index of -1.
# - For each point retrieve the corresponding opening curve if there is one.
# 
# Intermediate result:
# A list with duplicates of the opening curves in the same structure as the list of edge curves (1), each index has the corresponding opening curve (2) in it if the edge lies on a opening curve, or a Null-value if an edge has no relation with the opening curves.
# 
# - Sort the branches on lenght, which puts all the curves in the last indices, and Null values in front
# - For each branch select the last item (index -1) in order to get one value per branch (i.e. per region). NOTE: If a region is adjacent to an opening curve, the branch consists out of this corresponding opening curve. Else it will contain a Null-item.
# - Flatten this list, in order to get as many values as there are branches (i.e. regions). NOTE: list still contains Null-items.
# - For each opening curve (2), check equality with the list of the previous step.
# - Retrieve the Tree statistis (branches, i.e. regions) of the list of edge curves (1) and cull these paths using the pattern from the equality check.
# 
# Intermediate result:
# This results in a tree structure where each branch corresponds to an opening curve, and each branch consists out of the paths of the regions (from list 1) that are adjacent to this opening curve. (3)
# 
# - Retrieve the list lenght of each branch. If the list length is 2 or less (i.e. the opening curve has 2 or less faces) return True, else return False.
# - Retrieve the Tree statistics of this new list (3). Cull the paths using the pattern created in the previous step.
# - Select the branches from this list (3) using the branches (corresponding to the opening curves with 2 or less adjacent regions) that are left from the culling.
# 
# Intermediate result:
# This results in a tree structure where each branch corresponds to an opening curve which has 2 or less regions adjacent to it. Each branch consists out of the paths of the regions (from list 1) that are adjacent to this opening curve. (4)
# 
# - Selecting the desired branches that are left from the main list of edge curves (1) and replace the paths to the original paths.
# 
# Result:
# The edge curves of the regions adjacent to a opening curves that have 2 or less faces adjacent to them.
equals_5 = Equality(FirstNumber=simplify(graft(join_5)), SecondNumber=flatten(item_10))  # -> Equality, Inequality
tstat_4 = TreeStatistics(Tree=crv_13)  # -> flatten(Paths), Length, Count
cull_17 = CullPattern(List=tstat_4.Paths, CullPattern=equals_5.Equality)
python_2 = GhPythonScript(dataTree=cull_17)  # -> out, SelectedBranches; inputs dataTree: tree
# ---------- python_2: Python ----------
__author__ = "thoma"
__version__ = "2019.04.24"

import rhinoscriptsyntax as rs
import System.Object as so
import Grasshopper.DataTree as dt
import Grasshopper.Kernel.Data.GH_Path as ghp

####    CREATING DEFINITIONS

#Converting a Grasshopper dataTree to a nested list
def dataTreeToList(list):
    theList = []
    for i in range(list.BranchCount ):
        thisListPart = []
        thisBranch = list.Branch(i)
        for j in range(len(thisBranch)):
            thisListPart.append( thisBranch[j] )
        theList.append(thisListPart)
    return theList

#Converting a nested list back to a Grasshopper dataTree
def ListToDataTree(list):
    dataTree = dt[so]()
    for i, listItem in enumerate(list):
        for j, item in enumerate(listItem):
            p = ghp(i, j)
            try: dataTree.AddRange(item, p)
            except: dataTree.Add(item, p)
    return dataTree

#Select the data paths that are not yet modified in a nested list
def DeletePreviousModified(dataTree):
    SelectedBranches = []
    for elem in dataTree:
        path_nr = []
        for int in elem:
            if int.find(";") == -1:
                path_nr.append(int)
        SelectedBranches.append(path_nr)
    return SelectedBranches

####    IMPORTING GRASSHOPPER DATA AND OBJECTS
dataTree = dataTreeToList(dataTree)

####    MAIN CODE
SelectedBranches = DeletePreviousModified(dataTree)
print SelectedBranches
SelectedBranches = ListToDataTree(SelectedBranches)
print SelectedBranches
# ---------- end python_2 ----------
item_11 = ListItem(List=python_2.SelectedBranches, Index=0, Wrap=False)  # -> Item, Item1, Item2, Item3
concat = Concatenate(FragmentA=item_11.Item, FragmentB=item_11.Item1, FragmentC=item_11.Item2, FragmentD=item_11.Item3)  # -> simplify(Result)
cluster_4 = Cluster(T=concat)
panel_6 = Panel(concat)
python_3 = GhPythonScript(main_list=crv_7, desired_paths=cluster_4)  # -> out, selection; inputs main_list: tree of Curve, desired_paths: tree of Int32
# ---------- python_3: Python ----------
__author__ = "thoma"
__version__ = "2019.04.24"

import rhinoscriptsyntax as rs
import System.Object as so
import Grasshopper.DataTree as dt
import Grasshopper.Kernel.Data.GH_Path as ghp

####    CREATING DEFINITIONS

#Converting a Grasshopper dataTree to a nested list
def dataTreeToList(list):
    theList = []
    for i in range(list.BranchCount ):
        thisListPart = []
        thisBranch = list.Branch(i)
        for j in range(len(thisBranch)):
            thisListPart.append( thisBranch[j] )
        theList.append(thisListPart)
    return theList

#Converting a nested list back to a Grasshopper dataTree
def ListToDataTree(list):
    dataTree = dt[so]()
    for i, listItem in enumerate(list):
        for j, item in enumerate(listItem):
            p = ghp(i, j)
            try: dataTree.AddRange(item, p)
            except: dataTree.Add(item, p)
    return dataTree

#Select the desired data paths and organise in a nested list
def SelectPaths(paths, mainlist):
    dlist = []
    for elem in paths:
        path_nr = []
        for int in elem:
            path_nr.append(mainlist[int])
            print path_nr
        dlist.append(path_nr)
    return dlist

####    IMPORTING GRASSHOPPER DATA AND OBJECTS
mlist = dataTreeToList(main_list)
dpaths = dataTreeToList(desired_paths) #AS INTEGER, NO "{ }"

####    MAIN CODE
selection = SelectPaths(dpaths, mlist)
print selection
selection = ListToDataTree(selection)
# ---------- end python_3 ----------
tstat_5 = TreeStatistics(Tree=python_3.selection)  # -> Paths, Length, Count
replace_2 = ReplacePaths(Data=python_3.selection, Search=tstat_5.Paths, Replace=flatten(concat))

# ----
# Split the selected branches from boundary edge
panel_7 = Panel("0.5")
eval_16 = EvaluateCurve(Curve=reparameterize(replace_2), Parameter=panel_7)  # -> Point, Tangent, Angle
join_6 = JoinCurves(Curves=crv_12, Preserve=False)
incurves_5 = PointInCurves(Point=eval_16.Point, Curves=join_6)  # -> Relationship, Index, Point
eval_17 = Evaluate(F="if(x=1, True, False)", x=incurves_5.Relationship)
cull_18 = CullPattern(List=replace_2, CullPattern=invert(eval_17))
cull_19 = CullPattern(List=replace_2, CullPattern=eval_17)
cluster_5 = Cluster_2(relay_2=cull_19, relay=cull_18)  # -> crv_bound, L, L_2
crv_14 = Curve(cluster_5.crv_bound)
crv_15 = Curve(cluster_5.L)
# PSEUDOCODE: Desired result:
# Each region of the selection splitted into two regions perpendicular to the opening curve. These should be organized in the original tree branches with sub-branches {X;0} and {X;1}.
# 
# - For all curves in each branch, evaluate the curve at parameter 0.5 in order to construct a point in the middle of the curve.
# - Check whether a point lies on an opening curve. Select the curves that lay on the opening curves by culling the lists with the constructed boolean pattern.
# - Select the other curves by culling the lists with the inverse pattern.
# 
# Intermediate result:
# One list with the edge curves that lay on the opening curves (1) and one list with all other edge curves of a region (2). Each list is sorted in a branches corresponding to the regions of the whole.
# 
# - Take the endpoints of the curves in list (1)
# - For each curve of the list of rest curves (2) find the closest point of the end points on this curve. NOTE: For each curve in list (2) this will give two points, one of the start- and one of the endpoint of the curve in list (1).
# - Retrieve the distances of the closest points on the curves to the original points and select the one with the smallest distance.
# - For each point left, if this distance is equal to 0, return False, else return True.
# - Cull the rest curves (2) with this pattern. NOTE: The curves left are curves that do not touch the curves from list (1), i.e. opposite curves.
# 
# Intermediate result:
# One list with the edge curves that lay on the opening curves, i.e. on the boundary (1). One list with the curves opposite of the curves in the previous list (2) and one list with the other two curves connecting them.(3)
# 
# - For the curves in list (1) and list (2) (i.e. the opposite curves), construct a point in the middle of these curves by evaluating the curve at parameter 0.5.
# - For each branch (i.e. region), interpolate a line between these constructed points.
# - Parallel to this, construct a boundary surface between the original edge curves of each region.
# - Split these boundary surfaces with the lines constructed 3 steps back.
# - Retrieve the edges of the surfaces using Brep Edges, so that for each original branch 2 new ones are created like {X;0} and {X;1} each representing one of the two surfaces of the split.
# - Join these edges into closed polylines.
# 
# Intermediate result:
# A list of the boundary curves of the new regions as closed polylines. These are organized in the original tree branches with sub-branches {X;0} and {X;1}.(4) These closed polylines now need to be shattered into 4 segments representing the actual edges from vertex to vertex.
# 
# - For each branch retrieve the original vertices and merge them with the new vertices from the split.
# - Duplicate each branch and assign the branches new paths as {X;0} and {X;1} in order to correspond to the new regions.
# - For each point in each branch check whether it lies on the boundary curve (4). If it's on the curve, return True, else return False.
# - Cull the points based on this boolean pattern. NOTE: This step is necessary, because the branches consisted out of the original vertices (i.e. from the regions before the division) together with the new points. Therefore they consisted out of six points instead of four, with 2 of them laying outside the divided region. We only need the ones on the boundary of the corresponding region.
# - For each point, find the closest point on the corresponding boundary curve of the region in order to find the parameter on the curve.
# - Shatter the boundary curve at the found parameters in order to divide the boundary curve in the desired 4 segments.
# - Parallel to this select the edge curves of the paths that are not modified, and merge them with the modified ones.
# 
# Result:
# Each region of the selection splitted into two regions perpendicular to the opening curve. These are organized in the original tree branches with sub-branches {X;0} and {X;1}.
crv_16 = Curve(cluster_5.L_2)
divide_5 = DivideCurve(Curve=crv_14, Count=number_slider, Kinks=False)  # -> Points, Tangents, Parameters
# PSEUDOCODE: NOTE:
# This part of the algorithm is repeated for the regions adjacent to the modified regions. The result after the first iteration includes vertices at the middle of an edge, this doesn't work with the meshing. Therefore the adjacent regions also need to be split.
# 
# The algorithm can be copied, but instead of the opening curves, the 'opposite curves' of the opening curves are used as retrieved in the algorithm of the first iteration as well.
divide_6 = DivideCurve(Curve=crv_15, Count=number_slider, Kinks=False)  # -> Points, Tangents, Parameters
ln_5 = Line(StartPoint=divide_5.Points, EndPoint=reverse(divide_6.Points))
panel_8 = Panel("""0
-1""")
cull_i_3 = CullIndex(List=ln_5, Indices=panel_8, Wrap=True)  # -> simplify(List)
boundary_3 = BoundarySurfaces(Edges=replace_2)
crv_17 = Curve(cull_i_3)
srfsplit_3 = SurfaceSplit(Surface=boundary_3, Curves=crv_17)  # -> simplify(Fragments)
edges_3 = BrepEdges(Brep=srfsplit_3)  # -> Naked, Interior, NonManifold
python_4 = GhPythonScript(Paths_mod=cluster_4, Paths_ori=tstat_4.Paths)  # -> out, output; inputs Paths_mod: tree of Int32, Paths_ori: list
# ---------- python_4: Python ----------
import rhinoscriptsyntax as rs
import Grasshopper.DataTree

newlist = []
for branch in range(Paths_mod.BranchCount):
    for i in range(len(Paths_mod.Branch(branch))):
        newlist.append("{"+str(Paths_mod.Branch(branch)[i])+"}")

print Paths_ori

for i in newlist:
    Paths_ori.remove(i)

print Paths_ori

output = Paths_ori
# ---------- end python_4 ----------
join_7 = JoinCurves(Curves=edges_3.Naked, Preserve=False)  # -> reparameterize(simplify(Curves))
branch_5 = TreeBranch(Tree=crv_13, Path=python_4.output, MaintainPaths=True)
end_3 = EndPoints(Curve=[cull_i_3, crv_16])  # -> Start, End
accuracy_2 = Slider(0.05, range=0..0.1)
crv_cp_5 = CurveClosestPoint(Point=flatten([end_3.Start, end_3.End]), Curve=reparameterize(join_7))  # -> Point, Parameter, Distance
eval_18 = Evaluate(F="if(x≤y, True, False)", x=crv_cp_5.Distance, y=accuracy_2)
cull_20 = CullPattern(List=crv_cp_5.Parameter, CullPattern=eval_18)
shatter_8 = Shatter(Curve=reparameterize(join_7), Parameters=cull_20)  # -> simplify(Segments)
merge_7 = Merge(Data1=shatter_8, Data2=branch_5)

# ----
# OUTPUT / INPUT
# 1. Object (as Mesh)
# 2. Boundary curve (projected in 2D plane)
# 3. Opening curves (projected in 2D plane)
# 4. Connectivity diagram based on topological skeleton
# (organized by area, in seperate branches)
outer_boundary_cuve_4 = Curve(flatten(outer_boundary_cuve_2))
opening_curves_5 = Curve(flatten(opening_curves_3))
connectivity_diagram = Curve(merge_7)

geo = Geometry(mesh)

# ----
# Modifying 3-sided regions into 4-sided regions in order to make these quad-faces in the mesh instead of triangular faces
data = Data(connectivity_diagram)
lng = ListLength(List=data)  # -> flatten(Length)
tstat_6 = TreeStatistics(Tree=data)  # -> Paths, Length, Count
eval_19 = Evaluate(F="if(x=3, True, False)", x=lng)
cull_21 = CullPattern(List=tstat_6.Paths, CullPattern=invert(eval_19))
cull_22 = CullPattern(List=tstat_6.Paths, CullPattern=eval_19)
branch_6 = TreeBranch(Tree=data, Path=cull_21, MaintainPaths=True)
branch_7 = TreeBranch(Tree=data, Path=cull_22, MaintainPaths=True)
list = ValueList({"Point": 0, "Curve": 1, "Arc": 2, "Circle": 3, "Ellipse": 4, "Line": 5, "Polyline": 6, "Surface": 7, "Brep": 8, "Mesh": 9, "Polysurface": 10, "Block": 11, "Text": 12, "TextDot": 13, "Dimension": 14, "LinearDimension": 15, "AngularDimension": 16, "Hatch": 17, "Leader": 18}, selected="Line")
# PSEUDOCODE: Desired result:
# All areas with 3 edges (triangular regions), which consequently have 3 vertices, converted to areas with 4 edges and consequently 4 vertices. This is important for initializing a quad mesh based on the vertex connectivity of this constructed topology. NOTE: The areas with 3 edges only occur at the boundary, at the location of singular faces. Therefore these areas only consist of curve-like elements (parts of the boundary curve) and line-like elements (S-B branches).
# 
# - Retrieve the list lenght of each branch.
# - If list length is 3, return True, else return False.
# - Cull the branches using this pattern in order to get the areas with only 3 edges.
# - Also cull the branches with the inverse pattern, this will be used to later merge with the modified branches.
# 
# - Use the Filter Type component to filter all lines. Retrieve the Boolean pattern for Null items using the Null item component.
# - Cull out the Line-types using this pattern, so only the Curve-types (parts of the boundary curve) are left.
# - Split these planar curves at the middle of the curve using the shatter component at parameter 0.5.
# - Merge the curves with the previously culled lines.
# - Merge the modified branches with the other branches.
# 
# Result:
# All areas now have 4 edges, consequently 4 vertices, which will form the base for the coarse quad mesh. This topological skeleton, will be used as a connectivity diagram for initializing a mesh.
filtertype = FilterByType(Geometry=branch_7, ObjectType=list)
null = NullItem(Item=filtertype)  # -> NullFlags, InvalidFlags, Description
cull_23 = CullPattern(List=branch_7, CullPattern=invert(null.NullFlags))
cull_24 = CullPattern(List=branch_7, CullPattern=null.NullFlags)
item_12 = ListItem(List=cull_24, Index="-1", Wrap=True)
shatter_9 = Shatter(Curve=reparameterize(item_12), Parameters=Slider(0.5, range=0..1))  # -> simplify(Segments)
merge_8 = Merge(Data1=cull_23, Data2=shatter_9)
merge_9 = Merge(Data1=branch_6, Data2=merge_8)

# ----
# OUTPUT / INPUT
# 1. Object (as Mesh)
# 2. Boundary curve (projected in 2D plane)
# 3. Opening curves (projected in 2D plane)
# 4a. Connectivity diagram based on topological skeleton
# (organized by area, in seperate branches)
# > With 3-sided regions
# 4b. Connectivity diagram based on topological skeleton
# (organized by area, in seperate branches)
# > Only quadrangular regions
opening_curves_6 = Curve(flatten(opening_curves_5))
outer_boundary_cuve_5 = Curve(flatten(outer_boundary_cuve_4))
connectivity_diagram_2 = Curve(connectivity_diagram)
connectivity_diagram_3 = Curve(merge_9)
geo_2 = Geometry(geo)

end_4 = EndPoints(Curve=connectivity_diagram_2)  # -> Start, End
outer_boundary_cuve_6 = Curve(flatten(outer_boundary_cuve_5))
opening_curves_7 = Curve(flatten(opening_curves_6))
geo_3 = Geometry(geo_2)

# ----
# Mapping connectivity structure on 3D surface as base for the meshing
geo_4 = Geometry(geo_2)

pt_4 = Point(end_4.Start)
incurves_6 = PointInCurves(Point=pt_4, Curves=outer_boundary_cuve_6)  # -> Relationship, Index, Point
eval_20 = Evaluate(F="if(x=1, True, False)", x=incurves_6.Relationship)
cull_25 = CullPattern(List=pt_4, CullPattern=invert(eval_20))
cull_26 = CullPattern(List=pt_4, CullPattern=eval_20)
incurves_7 = PointInCurves(Point=cull_25, Curves=opening_curves_7)  # -> Relationship, Index, Point
crv_cp_6 = CurveClosestPoint(Point=cull_26, Curve=outer_boundary_cuve_6)  # -> Point, Parameter, Distance
item_13 = ListItem(List=opening_curves_7, Index=incurves_7.Index, Wrap=True)
eval_21 = Evaluate(F="if(x=1, True, False)", x=incurves_7.Relationship)
cull_27 = CullPattern(List=item_13, CullPattern=eval_21)
cull_28 = CullPattern(List=cull_25, CullPattern=invert(eval_21))
cull_29 = CullPattern(List=cull_25, CullPattern=eval_21)
Z = UnitZ(Factor=1)
crv_cp_7 = CurveClosestPoint(Point=cull_29, Curve=cull_27)  # -> Point, Parameter, Distance
project_3 = ProjectPoint(Point=cull_28, Direction=Z, Geometry=geo_4)  # -> Point, Index
crv_cp_8 = CurveClosestPoint(Point=crv_cp_6.Point, Curve=outer_boundary_cuve_6)  # -> Point, Parameter, Distance
index = ItemIndex(List=pt_4, Item=cull_29)
index_2 = ItemIndex(List=pt_4, Item=cull_28)
index_3 = ItemIndex(List=pt_4, Item=cull_26)
replace_3 = ReplaceItems(List=pt_4, Item=crv_cp_8.Point, Indices=index_3, Wrap=False)
replace_4 = ReplaceItems(List=replace_3, Item=crv_cp_7.Point, Indices=index, Wrap=False)
replace_5 = ReplaceItems(List=replace_4, Item=project_3.Point, Indices=index_2, Wrap=False)

pt_5 = Point(end_4.End)
incurves_8 = PointInCurves(Point=pt_5, Curves=outer_boundary_cuve_6)  # -> Relationship, Index, Point
eval_22 = Evaluate(F="if(x=1, True, False)", x=incurves_8.Relationship)
cull_30 = CullPattern(List=pt_5, CullPattern=invert(eval_22))
cull_31 = CullPattern(List=pt_5, CullPattern=eval_22)
incurves_9 = PointInCurves(Point=cull_30, Curves=opening_curves_7)  # -> Relationship, Index, Point
crv_cp_9 = CurveClosestPoint(Point=cull_31, Curve=outer_boundary_cuve_6)  # -> Point, Parameter, Distance
item_14 = ListItem(List=opening_curves_7, Index=incurves_9.Index, Wrap=True)
eval_23 = Evaluate(F="if(x=1, True, False)", x=incurves_9.Relationship)
cull_32 = CullPattern(List=item_14, CullPattern=eval_23)
cull_33 = CullPattern(List=cull_30, CullPattern=invert(eval_23))
cull_34 = CullPattern(List=cull_30, CullPattern=eval_23)
Z_2 = UnitZ(Factor=1)
crv_cp_10 = CurveClosestPoint(Point=cull_34, Curve=cull_32)  # -> Point, Parameter, Distance
project_4 = ProjectPoint(Point=cull_33, Direction=Z_2, Geometry=geo_4)  # -> Point, Index
crv_cp_11 = CurveClosestPoint(Point=crv_cp_9.Point, Curve=outer_boundary_cuve_6)  # -> Point, Parameter, Distance
index_4 = ItemIndex(List=pt_5, Item=cull_33)
index_5 = ItemIndex(List=pt_5, Item=cull_34)
index_6 = ItemIndex(List=pt_5, Item=cull_31)
replace_6 = ReplaceItems(List=pt_5, Item=crv_cp_11.Point, Indices=index_6, Wrap=False)
replace_7 = ReplaceItems(List=replace_6, Item=crv_cp_10.Point, Indices=index_5, Wrap=False)
replace_8 = ReplaceItems(List=replace_7, Item=project_4.Point, Indices=index_4, Wrap=False)

ln_6 = Line(StartPoint=replace_5, EndPoint=replace_8)

# ----
# OUTPUT / INPUT
# 1. Object (as Mesh)
# 2. Three dimensional connectivity diagram
# 3. Opening curves (projected in 2D plane)
number_slider_2 = Slider(2, range=0..3)
connectivity_diagram_4 = Curve(ln_6)

# ----
# Initializing the coarse quad mesh and subdividing it into the desired density.
wbweave = WeaverbirdsMeshFromLinesWeaveBack(Lines=connectivity_diagram_4, MaximumValence=4)  # -> flatten(Mesh)
# PSEUDOCODE: - Initialize a mesh face from the 4 lines of each area (in different branches) using Weaverbird's Mesh From Lines component.
# - Use Weaverbird's Join Meshes and Weld component to make 1 mesh from all loose faces. (Flatten the tree first into 1 branch)
# - Use Weaverbird's CatmullClark Subdivision to subdivide the mesh into a desired density.
# 
# Result:
# A mesh of the shape, which is ready to relax onto the surface using Kangaroo components.
wbjoin = WeaverbirdsJoinMeshesAndWeld(Mesh=wbweave, Weld=invert(False))
unim = UnifyMesh(Mesh=wbjoin)  # -> Result, Count
wbcatmullclark = WeaverbirdsCatmullClarkSubdivision(MeshCurves=unim.Result, Level=number_slider_2, SmoothNakedEdges=2)
panel_9 = Panel(wbcatmullclark)

# ----
# OUTPUT / INPUT
# 1. Object (as Mesh)
# 2. Quad Mesh
geo_5 = Geometry(geo_3)
mesh_2 = Mesh(wbcatmullclark)

# ----
# Initializing the coarse quad mesh and subdividing it into the desired density.
mesh_3 = Mesh(mesh_2)
demesh_3 = DeconstructMesh(Mesh=mesh_3)  # -> Vertices, Faces, Colours, Normals
# PSEUDOCODE: Desired result:
# All vertices of the mesh laying on the shape. This is done using the Kangaroo solver.
# 
# - Deconstruct the mesh and retrieve the vertices.
# - For each vertex find the closest point to the mesh.
# - Attach the closest point of each vertex to the corresponding vertex as anchor.
# 
# Intermediate result:
# By default Kangaroo wil set the strength high (+/- 1e+11) and the points will therefore be pulled towards the shape.
# 
# - Enable the simulation.
# - Retrieve the input mesh as output.
# 
# Result:
# The densified mesh on the design shape.
meshcp = MeshClosestPoint(Point=demesh_3.Vertices, Mesh=geo_5)  # -> Point, Index, Parameter
anchor = Anchor(Point=demesh_3.Vertices, Target=meshcp.Point, Strength=1e+11)
show = Show(G=mesh_3)
solver = Solver(GoalObjects=flatten([show, anchor]), Reset=Button(), Threshold=1e-15, Tolerance=0.01, On=Toggle(True))  # -> I, simplify(V), O
mesh_4 = Mesh(solver.O)
null_2 = NullItem(Item=mesh_4)  # -> NullFlags, InvalidFlags, Description
cull_35 = CullPattern(List=mesh_4, CullPattern=invert(null_2.NullFlags))

# ----
# OUTPUT / INPUT
# 1. Object (as Mesh)
# 2. Quad Mesh
mesh_5 = Mesh(cull_35)
geo_6 = Geometry(geo_5)

mesh_6 = Mesh(mesh_5)
demesh_4 = DeconstructMesh(Mesh=mesh_6)  # -> Vertices, simplify(graft(Faces)), Colours, Normals
wbedges = WeaverbirdsMeshEdges(MeshOrPolylines=mesh_6)
wbnaked = WeaverbirdsNakedBoundary(MeshClosedPolylines=mesh_6)
sort_4 = SortList(Keys=wbnaked, ValuesA=wbnaked)  # -> Keys, ValuesA
cluster_6 = Cluster_4(line=wbedges, C=wbnaked)
explode_2 = Explode(Curve=sort_4.ValuesA, Recursive=True)  # -> simplify(Segments), simplify(Vertices)
graft_2 = GraftTree(Tree=sort_4.ValuesA, IncludeEmptyLists=True, IncludeNullItems=True)  # -> simplify(Tree)
len_4 = Length(Curve=explode_2.Segments)
avr_2 = Average(Input=len_4)
oncurve = OnCurve(Points=explode_2.Vertices, Curve=graft_2, Strength=Slider(5000, range=0..10000))
length_line = LengthLine(Line=explode_2.Segments, Length=avr_2, Strength=Slider(25, range=0..10000))
length_line_2 = LengthLine(Line=cluster_6, Length=Slider(0, range=0..1), Strength=Slider(1, range=0..10000))
onmesh = OnMesh(Points=demesh_4.Vertices, Mesh=geo_6, Strength=Slider(100, range=0..10000))
show_2 = Show(G=mesh_6)
bouncysolver = BouncySolver(
    GoalObjects=flatten([show_2, onmesh, length_line_2, length_line, oncurve]),
    Reset=Button(),
    Threshold=1e-15,
    Tolerance=0.01,
    Damping=Slider(0.99, range=0..1),
    Iterations=10,
    On=Toggle(True))  # -> I, V, O
item_15 = ListItem(List=bouncysolver.O, Index=0, Wrap=True)
unim_2 = UnifyMesh(Mesh=item_15)  # -> Result, Count

wbedges_2 = WeaverbirdsMeshEdges(MeshOrPolylines=unim_2.Result)

# ----
# CUSTOM VIEWER
colour = ColourPicker(PickedColour=RGBA(0, 74, 128, 73))
colour_2 = ColourPicker(PickedColour=RGBA(48, 178, 0, 62))
preview = CustomPreview(Geometry=wbedges_2, Material=colour)
preview_2 = CustomPreview(Geometry=geo_6, Material=colour_2)

# ----
# OUTPUT
# Used as input for the
# second definition described
# in Section 7.2 in report
# Final mesh representing
# panelization
# Original Shape (as Mesh)
geo_7 = Geometry(geo_6)
mesh_7 = Mesh(item_15)

# ==== cluster BUGFIX
relay = ClusterInput()
lng = ListLength(List=relay)  # -> flatten(Length)
tstat = TreeStatistics(Tree=relay)  # -> Paths, Length, Count
eval = Evaluate(F="if(x=4, False, True)", x=lng)
cull = CullPattern(List=tstat.Paths, CullPattern=invert(eval))
cull_2 = CullPattern(List=tstat.Paths, CullPattern=eval)
branch = TreeBranch(Tree=relay, Path=cull, MaintainPaths=True)
branch_2 = TreeBranch(Tree=relay, Path=cull_2, MaintainPaths=True)
list = ValueList({"Point": 0, "Curve": 1, "Arc": 2, "Circle": 3, "Ellipse": 4, "Line": 5, "Polyline": 6, "Surface": 7, "Brep": 8, "Mesh": 9, "Polysurface": 10, "Block": 11, "Text": 12, "TextDot": 13, "Dimension": 14, "LinearDimension": 15, "AngularDimension": 16, "Hatch": 17, "Leader": 18}, selected="Line")
list_2 = ValueList({"Point": 0, "Curve": 1, "Arc": 2, "Circle": 3, "Ellipse": 4, "Line": 5, "Polyline": 6, "Surface": 7, "Brep": 8, "Mesh": 9, "Polysurface": 10, "Block": 11, "Text": 12, "TextDot": 13, "Dimension": 14, "LinearDimension": 15, "AngularDimension": 16, "Hatch": 17, "Leader": 18}, selected="Polyline")
list_3 = ValueList({"Point": 0, "Curve": 1, "Arc": 2, "Circle": 3, "Ellipse": 4, "Line": 5, "Polyline": 6, "Surface": 7, "Brep": 8, "Mesh": 9, "Polysurface": 10, "Block": 11, "Text": 12, "TextDot": 13, "Dimension": 14, "LinearDimension": 15, "AngularDimension": 16, "Hatch": 17, "Leader": 18}, selected="Polyline")
list_4 = ValueList({"Point": 0, "Curve": 1, "Arc": 2, "Circle": 3, "Ellipse": 4, "Line": 5, "Polyline": 6, "Surface": 7, "Brep": 8, "Mesh": 9, "Polysurface": 10, "Block": 11, "Text": 12, "TextDot": 13, "Dimension": 14, "LinearDimension": 15, "AngularDimension": 16, "Hatch": 17, "Leader": 18}, selected="Line")
filtertype = FilterByType(Geometry=branch_2, ObjectType=list_4)
null = NullItem(Item=filtertype)  # -> NullFlags, InvalidFlags, Description
cull_3 = CullPattern(List=branch_2, CullPattern=null.NullFlags)
filtertype_2 = FilterByType(Geometry=cull_3, ObjectType=list_3)
null_2 = NullItem(Item=filtertype_2)  # -> NullFlags, InvalidFlags, Description
cull_4 = CullPattern(List=cull_3, CullPattern=null_2.NullFlags)
cull_5 = CullPattern(List=cull_3, CullPattern=invert(null_2.NullFlags))
cull_6 = CullPattern(List=branch_2, CullPattern=invert(null.NullFlags))
explode = Explode(Curve=cull_4, Recursive=True)  # -> Segments, Vertices
merge = Merge(Data1=simplify(cull_6), Data2=simplify(cull_5), Data3=simplify(explode.Segments))
lng_2 = ListLength(List=merge)  # -> flatten(Length)
tstat_2 = TreeStatistics(Tree=merge)  # -> Paths, Length, Count
eval_2 = Evaluate(F="if(x=4, False, if(x=3, False, True))", x=lng_2)
cull_7 = CullPattern(List=tstat_2.Paths, CullPattern=invert(eval_2))
cull_8 = CullPattern(List=tstat_2.Paths, CullPattern=eval_2)
branch_3 = TreeBranch(Tree=merge, Path=cull_7, MaintainPaths=True)
branch_4 = TreeBranch(Tree=merge, Path=cull_8, MaintainPaths=True)
filtertype_3 = FilterByType(Geometry=branch_4, ObjectType=list)
null_3 = NullItem(Item=filtertype_3)  # -> NullFlags, InvalidFlags, Description
cull_9 = CullPattern(List=branch_4, CullPattern=null_3.NullFlags)
filtertype_4 = FilterByType(Geometry=cull_9, ObjectType=list_2)
null_4 = NullItem(Item=filtertype_4)  # -> NullFlags, InvalidFlags, Description
cull_10 = CullPattern(List=cull_9, CullPattern=null_4.NullFlags)
join = JoinCurves(Curves=cull_10, Preserve=False)
cull_11 = CullPattern(List=branch_4, CullPattern=invert(null_3.NullFlags))
cull_12 = CullPattern(List=cull_9, CullPattern=invert(null_4.NullFlags))
pshift = ShiftPaths(Data=join, Offset=-1)
merge_2 = Merge(Data1=simplify(cull_11), Data2=simplify(cull_12), Data3=simplify(pshift))
merge_3 = Merge(Data1=branch, Data2=branch_3, Data3=merge_2)

# ---- group: Culling (almost 0 length lines)
len = Length(Curve=merge_3)
smaller = SmallerThan(FirstNumber=len, SecondNumber=Slider(0.01, range=0..1))  # -> SmallerThan, OrEqualTo
cull_13 = CullPattern(List=merge_3, CullPattern=invert(smaller.SmallerThan))

# ----
L = ClusterOutput(cull_13)

# ==== cluster Cluster
T = ClusterInput()
rep = ReplaceText(Text=T, Find="{", RecursiveReplace=False)
rep_2 = ReplaceText(Text=rep, Find="}", RecursiveReplace=False)
R = ClusterOutput(rep_2)

# ==== cluster Cluster_2
relay = ClusterInput()
relay_2 = ClusterInput()
end = EndPoints(Curve=relay_2)  # -> Start, End
crv_cp = CurveClosestPoint(Point=end.Start, Curve=relay)  # -> Point, Parameter, graft(Distance)
crv_cp_2 = CurveClosestPoint(Point=end.End, Curve=relay)  # -> Point, Parameter, graft(Distance)
hilo = HighestLowestNumbers(Numbers=[crv_cp.Distance, crv_cp_2.Distance])  # -> Highest, Lowest
pshift = ShiftPaths(Data=hilo.Lowest, Offset=-1)
eval = Evaluate(F="if(x≈0, False, True)", x=pshift)
cull = CullPattern(List=relay, CullPattern=invert(eval))
cull_2 = CullPattern(List=relay, CullPattern=eval)
L = ClusterOutput(cull_2)
crv_bound = ClusterOutput(relay_2)
L_2 = ClusterOutput(cull)

# ==== cluster Cluster_3
path = ClusterInput()
int = ClusterInput()
cluster = Cluster(T=path)
int_2 = Integer(flatten(int))
equals = Equality(FirstNumber=int_2, SecondNumber=graft(cluster))  # -> Equality, Inequality
sort = SortList(Keys=equals.Equality, ValuesA=equals.Equality)  # -> Keys, ValuesA
item = ListItem(List=sort.ValuesA, Index="-1", Wrap=True)  # -> flatten(Item)
cull = CullPattern(List=cluster, CullPattern=invert(item))
L = ClusterOutput(cull)

# ==== cluster Cluster_4
line = ClusterInput()
C = ClusterInput()
line_2 = Line(line)
explode = Explode(Curve=C, Recursive=True)  # -> flatten(Segments), Vertices
equals = Equality(FirstNumber=simplify(graft(line_2)), SecondNumber=explode.Segments)  # -> Equality, Inequality
sort = SortList(Keys=equals.Equality, ValuesA=equals.Equality)  # -> Keys, ValuesA
item = ListItem(List=sort.ValuesA, Index=-1, Wrap=True)  # -> flatten(Item)
cull = CullPattern(List=line_2, CullPattern=invert(item))
L = ClusterOutput(cull)

# ==== cluster ConstructPlane
B = ClusterInput()
C = ClusterInput()
bbox = BoundingBox(Content=C, Plane=PlaneXY(0, 0, 0))  # -> Box, Box_2
debox = DeconstructBox(Box=bbox.Box)  # -> Plane, X, Y, Z
dedomain = DeconstructDomain(Domain=debox.Z)  # -> Start, End
subtraction = Subtraction(A=dedomain.Start, B=B)
pt = ConstructPoint(XCoordinate=0, YCoordinate=0, ZCoordinate=subtraction)
xy = XYPlane(Origin=pt)
P = ClusterOutput(xy)
