# Grasshopper definition 2019-07-09_2_Approximation.gh (Grasshopper 1.0.7)
# plug-ins: Bifocals, Weaverbird, Kangaroo2 Components

level_of_subdivision = Slider(3, range=0..4)

# ----
# INPUT
# 1. Quadrangular subdivision
#     (as Mesh)
mesh = Mesh(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)

# ----
# NOTE:: This definition is created as part of the master thesis 'Subdivision and approximation of free-form steel structures' of Thomas van Loon.
# 
# This definition corresponds to section 7.2 in the thesis report.
# Subdividing all panels
# Retrieving faces corresponding to each panel
# Reconstructing meshes per panel
unim = UnifyMesh(Mesh=mesh)  # -> Result, Count
wbcatmullclark = WeaverbirdsCatmullClarkSubdivision(MeshCurves=unim.Result, Level=level_of_subdivision, SmoothNakedEdges=0)  # -> simplify(OutputMeshCurves)
demesh = DeconstructMesh(Mesh=wbcatmullclark)  # -> Vertices, simplify(graft(Faces)), Colours, Normals
viewer = ParamViewer(demesh.Faces)
pow = Power(A="4", B=level_of_subdivision)
dpath = DeconstructPath(Branch=viewer)
integer_division = IntegerDivision(A=dpath, B=pow)
replace = ReplacePaths(Data=demesh.Faces, Search=viewer, Replace=flatten(integer_division))
deface = DeconstructFace(Face=replace)  # -> graft(CornerA), graft(CornerB), graft(CornerC), graft(CornerD)
merge = Merge(Data1=deface.CornerA, Data2=deface.CornerB, Data3=deface.CornerC, Data4=deface.CornerD)
item = ListItem(List=demesh.Vertices, Index=merge, Wrap=True)
conmesh = ConstructMesh(Vertices=item, Faces={A=0, B=1, C=2, D=3})
pshift = ShiftPaths(Data=conmesh, Offset=-1)
wbjoin = WeaverbirdsJoinMeshesAndWeld(Mesh=pshift, Weld=invert(False))

concat = Concatenate(FragmentA="{", FragmentB=Slider(2, range=0..50), FragmentC="}")
branch = TreeBranch(Tree=wbjoin, Path=concat, MaintainPaths=True)

# ----
# Sorting meshfaces for the conversion to NURBS
# SORTING FACES
# Works for subdivision level 3
demesh_2 = DeconstructMesh(Mesh=wbjoin)  # -> simplify(Vertices), simplify(Faces), Colours, Normals
panel = Panel("""0
1
4
5
16
17
20
21
3
2
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""")
item_2 = ListItem(List=demesh_2.Faces, Index=panel, Wrap=True)
deface_2 = DeconstructFace(Face=simplify(graft(item_2)))  # -> CornerA, CornerB, CornerC, CornerD
merge_2 = Merge(Data1=deface_2.CornerA, Data2=deface_2.CornerB, Data3=deface_2.CornerC, Data4=deface_2.CornerD)
pshift_2 = ShiftPaths(Data=merge_2, Offset=-1)
item_3 = ListItem(List=demesh_2.Vertices, Index=pshift_2, Wrap=True)

# ----
# Projecting a vector onto a plane [EXAMPLE]
# As explained in the report, section 7.2.3
number_slider = Slider(3, range=0..10)
pl_3pt = Plane3Pt(
    PointA=<geometry referenced from the Rhino model>,
    PointB=<geometry referenced from the Rhino model>,
    PointC=<geometry referenced from the Rhino model>)
pln = Plane(pl_3pt)
deplane = DeconstructPlane(Plane=pln)  # -> Origin, XAxis, YAxis, ZAxis
vec = VectorXYZ(XComponent=number_slider, YComponent=Slider(4, range=0..10), ZComponent=Slider(5, range=0..10))  # -> Vector, Length
unit = UnitVector(Vector=vec.Vector)
python = GhPythonScript(u=unit, n=deplane.ZAxis)  # -> out, h, a, b; inputs u: Vector3d, n: Vector3d
# ---------- python: Python ----------
import Rhino.Geometry as rg
import Grasshopper as gh

import math as math

h=u-((u*n)/(n*n))*n

#h=u-(rg.Vector3d.Multiply(u,n)/rg.Vector3d.Multiply(n,n))*n

def ProjectOntoPlane(u,n):
    return u-((u*n)/(n*n))*n

DT=gh.DataTree[rg.Point3d]()

for i in range(0,10):
    DT.EnsurePath(i)
    for j in range(0,3):
        DT.Branch(i).Add(rg.Point3d(i*j,0,0))
a=DT
b=DT.Branch(4)[2]
# ---------- end python ----------
vdis = VectorDisplay(Anchor=deplane.Origin, Vector=unit)
vdis_2 = VectorDisplay(Anchor=deplane.Origin, Vector=deplane.ZAxis)
panel_2 = Panel(python.h)
vdis_3 = VectorDisplay(Anchor=deplane.Origin, Vector=python.h)

# ----
# Reconstructing meshes for each panel
panel_3 = Panel("4")
partition = PartitionList(List=item_3, Size=panel_3)
conmesh_2 = ConstructMesh(Vertices=partition, Faces={A=0, B=1, C=2, D=3})
pshift_3 = ShiftPaths(Data=conmesh_2, Offset=-1)
wbjoin_2 = WeaverbirdsJoinMeshesAndWeld(Mesh=pshift_3, Weld=invert(False))  # -> flatten(Mesh)

# ----
# Converting mesh to NURBS
sqrt = SquareRoot(Value=pow)
python_2 = GhPythonScript(pnts=partition, row_count=sqrt)  # -> out, output; inputs pnts: tree of Point3d, row_count: Int32
# ---------- python_2: Python ----------
import rhinoscriptsyntax as rs
import Rhino.Geometry as rg
import Grasshopper as gh
import math as math


#### INPUTS
pnts = pnts                 #Points to select, sort and use for the NURBS-surface
row_count = row_count       #Row count based on level of subdivision


#### CREATING DEFINITIONS
#Definition for dividing a list into sublists based on a maximum list length
def divide_list(list, length):
    for i in range(0, len(list), length):
        yield newpnts[i:i+length]

#Selecting the required points from the lists [panel][subface][vertices] in correct order
def select_points(list, row_count):
    pnts_sorted = []
    for i in range(len(list)):
        if (i+1) % row_count == 0:
            pnts_sorted.append(list[i][0])
            pnts_sorted.append(list[i][1])
        else:
            pnts_sorted.append(list[i][0])

    i_lastrow = (len(list) - row_count)
    for i in range(row_count):
        if (i_lastrow+1) % row_count == 0:
            pnts_sorted.append(list[i_lastrow][3])
            pnts_sorted.append(list[i_lastrow][2])
        else:
            pnts_sorted.append(list[i_lastrow][3])
        i_lastrow += 1

    return pnts_sorted

#Creating a NURBS surface through points sorted in a zigzag-structure (row by row)
def nurbs_through_points(pntlist, row_count):
    uvcount = int(row_count+1)
    surface = rg.NurbsSurface.CreateThroughPoints(pntlist, uvcount, uvcount, 3, 3, False, False)
    return surface


#### MAIN CODE
#Tree structure {A;B}[list] to [AB][listitem]
newpnts = []
for i in range(pnts.BranchCount):
    newpnts.append(pnts.Branch(i))

#Divide list to [A][B][listitem] > nested list [panel][meshfaces][face_vertices]
newpnts = list(divide_list(newpnts, 64))

#Sort points in Z-order (based on rows)
sortedpnts = []
for panel in newpnts:
    sortedpnts.append(list(select_points(panel, row_count)))

#Creating NURBS-surfaces based on the sorted points
nurbs = []
for panel in sortedpnts:
    nurbs.append(nurbs_through_points(panel, row_count))


#### OUTPUT
output = nurbs
# ---------- end python_2 ----------

panel_4 = Panel(wbjoin_2)
panel_5 = Panel(python_2.output)

# ----
# Selecting panels
panel_6 = Panel("""0
1
2
3
12
13
14
15
356
357
358
359
352
353
354
355
197
198
229
479
254
255""")
srf = Surface(python_2.output)
mesh_2 = Mesh(wbjoin_2)
item_4 = ListItem(List=flatten(mesh_2), Index=panel_6, Wrap=True)  # -> simplify(graft(Item))
item_5 = ListItem(List=flatten(srf), Index=panel_6, Wrap=True)

# ----
# Selecting one panel
number_slider_2 = Slider(0, range=0..100)
item_6 = ListItem(List=flatten(wbjoin_2), Index=number_slider_2, Wrap=True)
item_7 = ListItem(List=flatten(python_2.output), Index=number_slider_2, Wrap=True)

# ----
# Projecting vector u onto the target plane (See report, Section 7.2.3)
demesh_3 = DeconstructMesh(Mesh=item_6)  # -> Vertices, Faces, Colours, Normals
item_8 = ListItem(List=demesh_3.Vertices, Index="40", Wrap=True)
srf_cp = SurfaceClosestPoint(Point=item_8, Surface=reparameterize(item_7))  # -> Point, UVPoint, Distance
srf_cp_2 = SurfaceClosestPoint(Point=demesh_3.Vertices, Surface=reparameterize(item_7))  # -> Point, UVPoint, Distance
curvature = PrincipalCurvature(Surface=reparameterize(item_7), Point=srf_cp.UVPoint)  # -> Frame, Min, Max, MinDirection, MaxDirection
evalsrf = EvaluateSurface(Surface=reparameterize(item_7), Point=srf_cp_2.UVPoint)  # -> Point, Normal, UDirection, VDirection, Frame
evalsrf_2 = EvaluateSurface(Surface=reparameterize(item_7), Point=srf_cp.UVPoint)  # -> Point, Normal, UDirection, VDirection, Frame
abs = Absolute(Value=curvature.Min)
abs_2 = Absolute(Value=curvature.Max)
larger = LargerThan(FirstNumber=abs, SecondNumber=abs_2)  # -> LargerThan, OrEqualTo
eval = Evaluate(F="if(x=True, k1, k2)", x=larger.LargerThan, k1=curvature.MinDirection, k2=curvature.MaxDirection)
pl = ConstructPlane(Origin=evalsrf_2.Point, XAxis=eval, YAxis=evalsrf_2.Normal)
deplane_2 = DeconstructPlane(Plane=pl)  # -> Origin, XAxis, YAxis, ZAxis
unit_2 = UnitVector(Vector=evalsrf.Normal)
python_3 = GhPythonScript(n=deplane_2.ZAxis, u=unit_2)  # -> out, h, f; inputs n: Vector3d, u: list of Vector3d
# ---------- python_3: Python ----------
import Rhino.Geometry as rg
import Grasshopper as gh
import math as math

def ProjectOntoPlane(u,n):
    h = u-((u*n)/(n*n))*n
    return h

def ProjectionVector(u,n):
    f = -((u*n)/(n*n))*n
    return f

h = []
for item in u:
    h.append(ProjectOntoPlane(item,n))

f = []
for item in u:
    f.append(ProjectionVector(item,n))
# ---------- end python_3 ----------
mesh_3 = Mesh(item_6)
panel_7 = Panel(python_3.h)
rev = Reverse(Vector=python_3.h)
vdis_4 = VectorDisplay(Anchor=evalsrf.Point, Vector=rev)

# ----
# Projecting vector u onto the target plane (See report, Section 7.2.3)
srf_2 = Surface(simplify(graft(item_5)))
demesh_4 = DeconstructMesh(Mesh=item_4)  # -> simplify(Vertices), Faces, Colours, Normals
item_9 = ListItem(List=demesh_4.Vertices, Index="40", Wrap=True)
srf_cp_3 = SurfaceClosestPoint(Point=item_9, Surface=reparameterize(srf_2))  # -> Point, UVPoint, Distance
srf_cp_4 = SurfaceClosestPoint(Point=demesh_4.Vertices, Surface=reparameterize(srf_2))  # -> Point, UVPoint, Distance
curvature_2 = PrincipalCurvature(Surface=reparameterize(srf_2), Point=srf_cp_3.UVPoint)  # -> Frame, Min, Max, MinDirection, MaxDirection
evalsrf_3 = EvaluateSurface(Surface=reparameterize(srf_2), Point=srf_cp_4.UVPoint)  # -> Point, Normal, UDirection, VDirection, Frame
evalsrf_4 = EvaluateSurface(Surface=reparameterize(srf_2), Point=srf_cp_3.UVPoint)  # -> Point, Normal, UDirection, VDirection, Frame
abs_3 = Absolute(Value=curvature_2.Min)
abs_4 = Absolute(Value=curvature_2.Max)
larger_2 = LargerThan(FirstNumber=abs_3, SecondNumber=abs_4)  # -> LargerThan, OrEqualTo
eval_2 = Evaluate(F="if(x=True, k1, k2)", x=larger_2.LargerThan, k1=curvature_2.MinDirection, k2=curvature_2.MaxDirection)
pl_2 = ConstructPlane(Origin=evalsrf_4.Point, XAxis=eval_2, YAxis=evalsrf_4.Normal)
deplane_3 = DeconstructPlane(Plane=pl_2)  # -> Origin, XAxis, YAxis, ZAxis
unit_3 = UnitVector(Vector=evalsrf_3.Normal)
python_4 = GhPythonScript(n=deplane_3.ZAxis, u=unit_3)  # -> out, simplify(h); inputs n: Vector3d, u: list of Vector3d
# ---------- python_4: Python ----------
import Rhino.Geometry as rg
import Grasshopper as gh
import math as math

def ProjectOntoPlane(u,n):
    h = u-((u*n)/(n*n))*n
    return h

h = []
for item in u:
    h.append(ProjectOntoPlane(item,n))
# ---------- end python_4 ----------
mesh_4 = Mesh(item_4)

# ----
# Initializing goal objects (Section 7.2.4)
# Converting the goal to an objective in the dynamic relaxation
demesh_5 = DeconstructMesh(Mesh=mesh_3)  # -> simplify(graft(Vertices)), Faces, Colours, Normals
m_v_e_ang = ConnectedEdgeAngles(M=mesh_3, O=0)  # -> out, G, A, V, simplify(T), P; inputs M: Mesh
# ---------- m_v_e_ang: VB ----------
    Component.Params.Input(0).Name = "Mesh"
    Component.Params.Input(0).Description = "Open or closed mesh"
    Component.Params.Input(1).Name = "Mode"
    Component.Params.Input(1).Description = "Designates which angle to check against (0 = Average, 1 = Min, 2 = Max)"
    Component.Params.Input(2).Name = "Angle Domain"
    Component.Params.Input(2).Description = "The domain that describes the range of angles to be tested against"

    Component.Params.Output(1).Name = "Preview Mesh"
    Component.Params.Output(1).Description = "A greyscale preview mesh reflecting the range of values"
    Component.Params.Output(2).Name = "Angle"
    Component.Params.Output(2).Description = "The angle the vector normal to the connected edge direction as specified by the Mode input"
    Component.Params.Output(3).Name = "Values"
    Component.Params.Output(3).Description = "The list of all associated values to each sample point"
    Component.Params.Output(4).Name = "Topology"
    Component.Params.Output(4).Description = "The list of index values connected to the sample point"
    Component.Params.Output(5).Name = "Pattern"
    Component.Params.Output(5).Description = "If the R input is used, the status of each sample point relative to the provided range (0 = Below, 1 = Within, 2 = Above)"

    If M IsNot Nothing Then
      Dim i,j,k As Integer

      Dim iP As Grasshopper.Kernel.IGH_Param = Component.Params.Input(0)
      Dim cP As Grasshopper.Kernel.Data.IGH_Structure = iP.VolatileData

      Dim mf As Rhino.Geometry.Collections.MeshFaceList = Nothing
      Dim mv As Rhino.Geometry.Collections.MeshVertexList = Nothing
      Dim mtv As Rhino.Geometry.Collections.MeshTopologyVertexList = Nothing
      Dim mte As Rhino.Geometry.Collections.MeshTopologyEdgeList = Nothing
      Dim mn As Rhino.Geometry.Collections.MeshVertexNormalList = Nothing
      Dim mc As Rhino.Geometry.Collections.MeshVertexColorList = Nothing

      mf = m.Faces
      mv = m.Vertices
      mtv = m.TopologyVertices
      mte = m.TopologyEdges
      mn = m.Normals
      mc = m.VertexColors

      Dim avgAng As New list(Of Double)
      Dim arrVal As New DataTree(Of Double)
      Dim arrTop As New datatree(Of Integer)
      Dim oc As New list(Of color)
      Dim tv As Integer
      Dim aMin, aMax As Double
      Dim arrPat As New list(Of Integer)

      For i = 0 To mn.count() - 1 Step 1
        Dim tcv() As Integer
        tcv = mv.GetConnectedVertices(i)

        k = 0
        Dim tang,ang, tMin, tMax As New Double
        For j = 0 To ubound(tcv) Step 1
          Dim tvc As New Vector3d(mv.item(tcv(j)) - mv.item(i))

          tang = vector3d.VectorAngle(mn.item(i), tvc)
          If mv.item(i).distanceto(mv.item(tcv(j))) <> 0 Then
            arrVal.add(tang, cp.Path(Component.RunCount - 1).AppendElement(i))
            arrTop.add(tcv(j), cp.Path(Component.RunCount - 1).AppendElement(i))
            ang += tang
            If k = 0 Then tMin = tang Else If tang < tMin Then tMin = tang
            If tang > tMax Then tMax = tang
            k += 1
          End If
        Next

        If O = 1 Then
          ang = tMin
        ElseIf O = 2 Then
          ang = tMax
        Else
          ang /= k
        End If

        avgAng.add(ang)

        If i = 0 Then aMin = ang Else If ang < aMin Then aMin = ang
        If ang > aMax Then aMax = ang
      Next

      If R = Nothing Then
        R.t0 = amin
        R.t1 = amax
      End If

      For i = 0 To mn.count() - 1 Step 1
        If avgAng.item(i) < R.T0 Then
          oc.add(color.FromArgb(0, 0, 255))
          arrPat.add(0)
        ElseIf ((avgAng.item(i) > R.T1) Or ((r.t0 = 0) And (r.t1 = 0))) Then
          oc.add(color.FromArgb(255, 0, 0))
          arrPat.add(2)
        Else
          tv = math.Floor((avgAng.item(i) - R.T0) / (R.t1 - R.t0) * 255)
          oc.add(color.FromArgb(tv, tv, tv))
          arrPat.add(1)
        End If
      Next
      Dim mo As New mesh
      mo.vertices.AddVertices(mv)
      mo.Faces.AddFaces(mf)
      mo.VertexColors.AppendColors(oc.toarray())

      G = mo
      V = arrVal
      A = avgAng
      P = arrPat
      T = arrTop

    End If
# ---------- end m_v_e_ang ----------
graft = GraftTree(Tree=python_3.h, IncludeEmptyLists=True, IncludeNullItems=True)
pl_3 = PlaneNormal(Origin=demesh_5.Vertices, ZAxis=graft)  # -> simplify(Plane)
item_10 = ListItem(List=flatten(demesh_5.Vertices), Index=m_v_e_ang.T, Wrap=True)
cluster = Cluster_2(relay=item_10, P=pl_3)  # -> D, T
variable_strength = Slider(5, range=0..20)
multiplication = Multiplication(A=cluster.T, B=variable_strength)
fixed_strength = Slider(1, range=0..20)
addition = Addition(A=multiplication, B=fixed_strength)
onplane = OnPlane(Points=item_10, Plane=pl_3, Strength=addition)  # -> flatten(P)
panel_8 = Panel(addition)

# ----
# Coplanarity of edge curves
demesh_6 = DeconstructMesh(Mesh=mesh_4)  # -> Vertices, Faces, Colours, Normals
medges = MeshEdges(Mesh=mesh_4)  # -> NakedEdges, InteriorEdges, NonManifoldEdges
join = JoinCurves(Curves=medges.NakedEdges, Preserve=False)
splitatcorners = SplitAtCorners(Poly=join, Angle=1)  # -> Corners, Parts
lng = ListLength(List=splitatcorners.Parts)
item_11 = ListItem(List=flatten(lng), Index=0, Wrap=True)
lng_2 = ListLength(List=demesh_6.Vertices)
dup = DuplicateData(Data=demesh_6.Vertices, Number=item_11, Order=True)  # -> simplify(Data)
item_12 = ListItem(List=flatten(lng_2), Index=0, Wrap=True)
partition_2 = PartitionList(List=dup, Size=item_12)
crv_cp = CurveClosestPoint(Point=simplify(partition_2), Curve=simplify(graft(splitatcorners.Parts)))  # -> Point, Parameter, Distance
eval_3 = Evaluate(F="if(x=0, True, False)", x=crv_cp.Distance)
cull = CullPattern(List=partition_2, CullPattern=eval_3)
coplanar = CoPlanar(Points=cull, Strength=Slider(50, range=0..100))  # -> flatten(Coplanar)

# ----
# Coplanarity of edge curves
medges_2 = MeshEdges(Mesh=mesh_3)  # -> NakedEdges, InteriorEdges, NonManifoldEdges
demesh_7 = DeconstructMesh(Mesh=mesh_3)  # -> Vertices, Faces, Colours, Normals
join_2 = JoinCurves(Curves=medges_2.NakedEdges, Preserve=False)
splitatcorners_2 = SplitAtCorners(Poly=join_2, Angle=1)  # -> Corners, Parts
crv_cp_2 = CurveClosestPoint(Point=demesh_7.Vertices, Curve=simplify(graft(splitatcorners_2.Parts)))  # -> Point, Parameter, Distance
eval_4 = Evaluate(F="if(x=0, True, False)", x=crv_cp_2.Distance)
cull_2 = CullPattern(List=demesh_7.Vertices, CullPattern=eval_4)
coplanar_2 = CoPlanar(Points=cull_2, Strength=Slider(50, range=0..100))  # -> flatten(Coplanar)

# ----
# Goals for maintaining closeness
# to the original surface
wbjoin_3 = WeaverbirdsJoinMeshesAndWeld(Mesh=flatten(mesh_4), Weld=False)
demesh_8 = DeconstructMesh(Mesh=wbjoin_3)  # -> simplify(Vertices), Faces, Colours, Normals
wbedges = WeaverbirdsMeshEdges(MeshOrPolylines=wbjoin_3)
onmesh = OnMesh(Points=demesh_8.Vertices, Mesh=wbjoin_3, Strength=Slider(1, range=0..500))  # -> flatten(P)
anchor = Anchor(Point=demesh_8.Vertices, Strength=Slider(1, range=0..500))  # -> flatten(A)
length_line = LengthLine(Line=wbedges, Strength=Slider(1, range=0..500))  # -> flatten(Spring)

# ----
# Converting the goal to an objective in the dynamic relaxation
m_v_e_ang_2 = ConnectedEdgeAngles(M=wbjoin_3, O=0)  # -> out, G, A, V, simplify(T), P; inputs M: Mesh; same code as m_v_e_ang
# Initializing goal objects (Section 7.2.4)
demesh_9 = DeconstructMesh(Mesh=wbjoin_3)  # -> Vertices, Faces, Colours, Normals
lng_3 = ListLength(List=m_v_e_ang_2.T)  # -> flatten(Length)
item_13 = ListItem(List=demesh_9.Vertices, Index=m_v_e_ang_2.T, Wrap=True)  # -> flatten(Item)
partition_3 = PartitionList(List=lng_3, Size="81")  # -> simplify(Chunks)
partition_4 = PartitionList(List=demesh_9.Vertices, Size="81")  # -> simplify(Chunks)
ma = MassAddition(Input=partition_3)  # -> flatten(Result), PartialResults
graft_2 = GraftTree(Tree=partition_4, IncludeEmptyLists=True, IncludeNullItems=True)
graft_3 = GraftTree(Tree=python_4.h, IncludeEmptyLists=True, IncludeNullItems=True)
partition_5 = PartitionList(List=item_13, Size=ma.Result)  # -> simplify(Chunks)
pl_4 = PlaneNormal(Origin=graft_2, ZAxis=graft_3)  # -> simplify(Plane)
variable_strength_2 = Slider(5, range=0..20)
fixed_strength_2 = Slider(1, range=0..20)
partition_6 = PartitionList(List=partition_5, Size=partition_3)  # -> simplify(Chunks)
cluster_2 = Cluster_3(relay=partition_6, P=pl_4)  # -> D, T
multiplication_2 = Multiplication(A=cluster_2.T, B=variable_strength_2)
addition_2 = Addition(A=multiplication_2, B=fixed_strength_2)
onplane_2 = OnPlane(Points=partition_6, Plane=pl_4, Strength=addition_2)  # -> flatten(P)

# ----
# Goals for maintaining closeness
# to the original surface
demesh_10 = DeconstructMesh(Mesh=mesh_3)  # -> Vertices, Faces, Colours, Normals
wbedges_2 = WeaverbirdsMeshEdges(MeshOrPolylines=mesh_3)
anchor_2 = Anchor(Point=demesh_10.Vertices, Strength=Slider(1, range=0..20))
onmesh_2 = OnMesh(Points=demesh_10.Vertices, Mesh=mesh_3, Strength=Slider(1, range=0..20))
length_line_2 = LengthLine(Line=wbedges_2, Strength=Slider(1, range=0..20))

# ----
# Approximation for a single panel
show = Show(G=mesh_3)
solver = Solver(
    GoalObjects=flatten([show, onplane, anchor_2, length_line_2, onmesh_2, coplanar_2]),
    Reset=Button(),
    Threshold=1e-15,
    Tolerance=0.01,
    On=Toggle(False))  # -> I, V, O
item_14 = ListItem(List=solver.O, Index=0, Wrap=True)

# ----
# Approximation for a group of panels
button = Button()
show_2 = Show(G=wbjoin_3)  # -> flatten(G)
solver_2 = Solver(
    GoalObjects=flatten([show_2, onplane_2, anchor, length_line, onmesh, coplanar]),
    Reset=button,
    Threshold=1e-15,
    Tolerance=0.01,
    On=Toggle(False))  # -> I, V, O
item_15 = ListItem(List=solver_2.O, Index=0, Wrap=True)

# ----
# Visualizing curvature
demesh_11 = DeconstructMesh(Mesh=item_14)  # -> Vertices, Faces, Colours, Normals
deface_3 = DeconstructFace(Face=simplify(graft(demesh_11.Faces)))  # -> CornerA, CornerB, CornerC, CornerD
degree_u = Slider(3, range=1..3)
degree_v = Slider(3, range=1..3)
merge_3 = Merge(Data1=deface_3.CornerA, Data2=deface_3.CornerB, Data3=deface_3.CornerC, Data4=deface_3.CornerD)
item_16 = ListItem(List=demesh_11.Vertices, Index=merge_3, Wrap=True)
python_5 = GhPythonScript(pnts=item_16, row_count=sqrt, degree_u=degree_u, degree_v=degree_v)  # -> out, nurbs, controlpnts; inputs pnts: tree of Point3d, row_count: Int32, degree_u: Int32, degree_v: Int32
# ---------- python_5: Python ----------
import rhinoscriptsyntax as rs
import Rhino.Geometry as rg
import Grasshopper as gh
import math as math

pnts_sorted = []
for i in range(pnts.BranchCount):
    if (i+1) % row_count == 0:
        pnts_sorted.append(pnts.Branch(i)[0])
        pnts_sorted.append(pnts.Branch(i)[1])
    else:
        pnts_sorted.append(pnts.Branch(i)[0])

i_lastrow = (pnts.BranchCount - row_count)
for i in range(row_count):
    if (i_lastrow+1) % row_count == 0:
        pnts_sorted.append(pnts.Branch(i_lastrow)[3])
        pnts_sorted.append(pnts.Branch(i_lastrow)[2])
    else:
        pnts_sorted.append(pnts.Branch(i_lastrow)[3])
    i_lastrow += 1

nurbs = []
uvcount = int(row_count+1)
pointcloud = pnts_sorted
surface = rg.NurbsSurface.CreateThroughPoints(pointcloud, uvcount, uvcount, degree_u, degree_v, False, False)
nurbs.append(surface)

nurbs = nurbs
controlpnts = pointcloud
# ---------- end python_5 ----------
srf_cp_5 = SurfaceClosestPoint(Point=python_5.controlpnts, Surface=reparameterize(python_5.nurbs))  # -> Point, UVPoint, Distance
curvature_3 = SurfaceCurvature(Surface=reparameterize(python_5.nurbs), Point=srf_cp_5.UVPoint)  # -> Frame, Gaussian, Mean
bnd = Bounds(Numbers=curvature_3.Gaussian)
list_of_gaussian_curvatures = Panel(curvature_3.Gaussian)
avr = Average(Input=curvature_3.Gaussian)
dedomain = DeconstructDomain(Domain=bnd)  # -> Start, End
gradient = Gradient(
    LowerLimit=dedomain.Start,
    UpperLimit=dedomain.End,
    Parameter=curvature_3.Gaussian,
    stops=[0: RGB(234, 38, 0), 0.246: RGB(234, 126, 0), 0.501: RGB(254, 244, 84), 0.751: RGB(173, 203, 249), 1: RGB(75, 107, 169)])
average_gaussian_curvature = Panel(avr)
mcol = MeshColours(Mesh=item_14, Colours=gradient)

# ----
# Curvature analysis
average_gaussian_curvature_2 = Panel(avr)

# ----
# Visualizing curvature
demesh_12 = DeconstructMesh(Mesh=item_15)  # -> Vertices, Faces, Colours, Normals
partition_7 = PartitionList(List=demesh_12.Faces, Size=pow)  # -> simplify(Chunks)
deface_4 = DeconstructFace(Face=simplify(graft(partition_7)))  # -> CornerA, CornerB, CornerC, CornerD
merge_4 = Merge(Data1=deface_4.CornerA, Data2=deface_4.CornerB, Data3=deface_4.CornerC, Data4=deface_4.CornerD)
item_17 = ListItem(List=demesh_12.Vertices, Index=merge_4, Wrap=True)
python_6 = GhPythonScript(pnts=item_17, row_count=sqrt)  # -> out, nurbs, controlpnts; inputs pnts: tree of Point3d, row_count: Int32
# ---------- python_6: Python ----------
import rhinoscriptsyntax as rs
import Rhino.Geometry as rg
import Grasshopper as gh
import math as math


#### INPUTS
pnts = pnts                 #Points to select, sort and use for the NURBS-surface
row_count = row_count       #Row count based on level of subdivision


#### CREATING DEFINITIONS
#Definition for dividing a list into sublists based on a maximum list length
def divide_list(list, length):
    for i in range(0, len(list), length):
        yield newpnts[i:i+length]

#Selecting the required points from the lists [panel][subface][vertices] in correct order
def select_points(list, row_count):
    pnts_sorted = []
    for i in range(len(list)):
        if (i+1) % row_count == 0:
            pnts_sorted.append(list[i][0])
            pnts_sorted.append(list[i][1])
        else:
            pnts_sorted.append(list[i][0])

    i_lastrow = (len(list) - row_count)
    for i in range(row_count):
        if (i_lastrow+1) % row_count == 0:
            pnts_sorted.append(list[i_lastrow][3])
            pnts_sorted.append(list[i_lastrow][2])
        else:
            pnts_sorted.append(list[i_lastrow][3])
        i_lastrow += 1

    return pnts_sorted

#Creating a NURBS surface through points sorted in a zigzag-structure (row by row)
def nurbs_through_points(pntlist, row_count):
    uvcount = int(row_count+1)
    surface = rg.NurbsSurface.CreateThroughPoints(pntlist, uvcount, uvcount, 3, 3, False, False)
    return surface


#### MAIN CODE
#Tree structure {A;B}[list] to [AB][listitem]
newpnts = []
for i in range(pnts.BranchCount):
    newpnts.append(pnts.Branch(i))

#Divide list to [A][B][listitem]
newpnts = list(divide_list(newpnts, 64))

#Sort points in Z-order (based on rows)
sortedpnts = []
for panel in newpnts:
    sortedpnts.append(list(select_points(panel, row_count)))

#Creating NURBS-surfaces based on the sorted points
nurbs = []
for panel in sortedpnts:
    nurbs.append(nurbs_through_points(panel, row_count))


#### OUTPUT
nurbs = nurbs

controlpnts = gh.DataTree[rg.Point3d]()

for i in range(len(sortedpnts)):
    controlpnts.EnsurePath(i)
    for j in range(len(sortedpnts[i])):
        controlpnts.Branch(i).Add(sortedpnts[i][j])

print controlpnts
# ---------- end python_6 ----------
srf_cp_6 = SurfaceClosestPoint(Point=python_6.controlpnts, Surface=reparameterize(python_6.nurbs))  # -> Point, UVPoint, Distance
curvature_4 = SurfaceCurvature(Surface=reparameterize(python_6.nurbs), Point=srf_cp_6.UVPoint)  # -> Frame, Gaussian, Mean
bnd_2 = Bounds(Numbers=flatten(curvature_4.Gaussian))
conmesh_3 = ConstructMesh(Vertices=item_17, Faces={A=0, B=1, C=2, D=3})
list_of_gaussian_curvatures_2 = Panel(curvature_4.Gaussian)
data = Data(Domain(-1.042556055, 0.06954573867))
avr_2 = Average(Input=flatten(curvature_4.Gaussian))
dedomain_2 = DeconstructDomain(Domain=data)  # -> Start, End
pshift_4 = ShiftPaths(Data=conmesh_3, Offset=-1)
gradient_2 = Gradient(
    LowerLimit=dedomain_2.Start,
    UpperLimit=dedomain_2.End,
    Parameter=curvature_4.Gaussian,
    stops=[0: RGB(234, 38, 0), 0.246: RGB(234, 126, 0), 0.501: RGB(254, 244, 84), 0.751: RGB(173, 203, 249), 1: RGB(75, 107, 169)])
average_gaussian_curvature_3 = Panel(avr_2)
wbjoin_4 = WeaverbirdsJoinMeshesAndWeld(Mesh=pshift_4, Weld=invert(False))
mcol_2 = MeshColours(Mesh=wbjoin_4, Colours=simplify(gradient_2))

# ----
# Curvature analysis
average_gaussian_curvature_4 = Panel(avr_2)

# ----
# Validating results
# Real time normal vectors
srf_cp_7 = SurfaceClosestPoint(Point=python_5.controlpnts, Surface=reparameterize(python_5.nurbs))  # -> Point, UVPoint, Distance
evalsrf_5 = EvaluateSurface(Surface=reparameterize(python_5.nurbs), Point=srf_cp_7.UVPoint)  # -> Point, Normal, UDirection, VDirection, Frame
rev_2 = Reverse(Vector=evalsrf_5.Normal)
vdis_5 = VectorDisplay(Anchor=evalsrf_5.Point, Vector=rev_2)

# ----
# Checking if all panel edges are planar curves
medges_3 = MeshEdges(Mesh=item_14)  # -> NakedEdges, InteriorEdges, NonManifoldEdges
demesh_13 = DeconstructMesh(Mesh=item_14)  # -> Vertices, Faces, Colours, Normals
join_3 = JoinCurves(Curves=medges_3.NakedEdges, Preserve=False)
splitatcorners_3 = SplitAtCorners(Poly=join_3, Angle=1)  # -> Corners, Parts
crv_cp_3 = CurveClosestPoint(Point=demesh_13.Vertices, Curve=simplify(graft(splitatcorners_3.Parts)))  # -> Point, Parameter, Distance
eval_5 = Evaluate(F="if(x=0, True, False)", x=crv_cp_3.Distance)
cull_3 = CullPattern(List=demesh_13.Vertices, CullPattern=eval_5)
alongcrv = SortAlongCurve(Points=cull_3, Curve=simplify(graft(splitatcorners_3.Parts)))  # -> Points, Indices
intcrv = Interpolate(Vertices=alongcrv.Points, Degree=3, Periodic=False, KnotStyle=1)  # -> Curve, Length, Domain
planar = Planar(Curve=intcrv.Curve)  # -> flatten(Planar), Plane, Deviation
avr_3 = Average(Input=planar.Planar)
eval_6 = Evaluate(F="if(x=1, True, False)", x=avr_3)
are_all_edges_planar_curves = Panel(eval_6)

# ----
# Gaussian Curvature
# Average + standard deviation
avr_4 = Average(Input=curvature_3.Gaussian)  # -> simplify(ArithmeticMean)
lng_4 = ListLength(List=curvature_3.Gaussian)  # -> simplify(Length)
python_7 = GhPythonScript(x=curvature_3.Gaussian, y=avr_4, z=lng_4)  # -> out, simplify(graft(s)); inputs x: tree, y: tree, z: tree
# ---------- python_7: Python ----------
import rhinoscriptsyntax as rs
import Grasshopper as gh
import math as math

newx = []
for i in range(x.BranchCount):
    newpartx = []
    for j in range(len(x.Branch(i))):
        newpartx.append(x.Branch(i)[j])
    newx.append(newpartx)

v = []
for i in range(len(newx)):
    vpart = []
    for j in range(len(newx[i])):
        vpart.append(math.pow((newx[i][j]-y.Branch(i)[0]), 2))
    v.append(vpart)

vsum = []
for i in range(len(v)):
    vsum.append(sum(v[i]))

s = []
for i in range(len(vsum)):
    s.append(math.sqrt(vsum[i]/z.Branch(i)[0]))

print s
# ---------- end python_7 ----------
concat_2 = Concatenate(FragmentA=avr_4, FragmentB=" +/- ", FragmentC=python_7.s)
panel_9 = Panel(concat_2)

# ----
# Checking if all panel edges are planar curves
conmesh_4 = ConstructMesh(Vertices=item_17, Faces={A=0, B=1, C=2, D=3})
pshift_5 = ShiftPaths(Data=conmesh_4, Offset=-1)
wbjoin_5 = WeaverbirdsJoinMeshesAndWeld(Mesh=pshift_5, Weld=invert(False))
medges_4 = MeshEdges(Mesh=wbjoin_5)  # -> NakedEdges, InteriorEdges, NonManifoldEdges
demesh_14 = DeconstructMesh(Mesh=wbjoin_5)  # -> Vertices, Faces, Colours, Normals
join_4 = JoinCurves(Curves=medges_4.NakedEdges, Preserve=False)
splitatcorners_4 = SplitAtCorners(Poly=join_4, Angle=1)  # -> Corners, simplify(Parts)
lng_5 = ListLength(List=splitatcorners_4.Parts)
item_18 = ListItem(List=flatten(lng_5), Index=0, Wrap=True)
lng_6 = ListLength(List=demesh_14.Vertices)
item_19 = ListItem(List=flatten(lng_6), Index=0, Wrap=True)
dup_2 = DuplicateData(Data=demesh_14.Vertices, Number=item_18, Order=True)  # -> simplify(Data)
partition_8 = PartitionList(List=dup_2, Size=item_19)
crv_cp_4 = CurveClosestPoint(Point=partition_8, Curve=simplify(graft(splitatcorners_4.Parts)))  # -> Point, Parameter, Distance
eval_7 = Evaluate(F="if(x=0, True, False)", x=crv_cp_4.Distance)
cull_4 = CullPattern(List=partition_8, CullPattern=eval_7)
alongcrv_2 = SortAlongCurve(Points=cull_4, Curve=simplify(graft(splitatcorners_4.Parts)))  # -> Points, Indices
intcrv_2 = Interpolate(Vertices=alongcrv_2.Points, Degree=3, Periodic=False, KnotStyle=1)  # -> Curve, Length, Domain
planar_2 = Planar(Curve=intcrv_2.Curve)  # -> flatten(Planar), Plane, Deviation
avr_5 = Average(Input=planar_2.Planar)
eval_8 = Evaluate(F="if(x=1, True, False)", x=avr_5)
are_all_edges_planar_curves_2 = Panel(eval_8)

# ----
# Real time normal vectors
graft_4 = GraftTree(Tree=python_6.nurbs, IncludeEmptyLists=True, IncludeNullItems=True)  # -> simplify(Tree)
# Validating results
panel_10 = Panel("""{0}
{1}""")
srf_cp_8 = SurfaceClosestPoint(Point=python_6.controlpnts, Surface=reparameterize(graft_4))  # -> Point, UVPoint, Distance
evalsrf_6 = EvaluateSurface(Surface=reparameterize(graft_4), Point=srf_cp_8.UVPoint)  # -> Point, Normal, UDirection, VDirection, Frame
branch_2 = TreeBranch(Tree=evalsrf_6.Point, Path=panel_10, MaintainPaths=True)
branch_3 = TreeBranch(Tree=evalsrf_6.Normal, Path=panel_10, MaintainPaths=True)
vdis_6 = VectorDisplay(Anchor=branch_2, Vector=branch_3)

# ----
# Gaussian Curvature
# Average + standard deviation
avr_6 = Average(Input=curvature_4.Gaussian)  # -> simplify(ArithmeticMean)
lng_7 = ListLength(List=curvature_4.Gaussian)  # -> simplify(Length)
python_8 = GhPythonScript(x=curvature_4.Gaussian, y=avr_6, z=lng_7)  # -> out, simplify(graft(s)); inputs x: tree, y: tree, z: tree; same code as python_7
concat_3 = Concatenate(FragmentA=avr_6, FragmentB=" +/- ", FragmentC=python_8.s)
panel_11 = Panel(concat_3)

# ----
# Average + SD
# ORIGINAL
data_2 = Data("0.009219 +/- 0.013915")
panel_12 = Panel(data_2)

# ----
# Comparing results with the original shape
data_3 = Data(0.01391482575)
data_4 = Data(0.009219496051)
subtraction = Subtraction(A=avr_4, B=data_4)
subtraction_2 = Subtraction(A=python_7.s, B=data_3)
cluster_3 = Cluster(A=subtraction, B=avr_4)

# ----
# Average + SD
# ORIGINAL
data_5 = Data(Tree({0}: ["0.018121 +/- 0.013608"], {1}: ["0.018075 +/- 0.014609"], {2}: ["0.017076 +/- 0.014761"], {3}: ["0.016934 +/- 0.015002"], {4}: ["0.018267 +/- 0.0133"], {5}: ["0.008264 +/- 0.015464"]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))
panel_13 = Panel(data_5)

# ----
# Comparing results with the original shape
data_6 = Data(Tree({0}: [0.01812146146], {1}: [0.01807501144], {2}: [0.01707609254], {3}: [0.01693384913], {4}: [0.01826702711], {5}: [0.008263657175]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))
data_7 = Data(Tree({0}: [0.01360803204], {1}: [0.01460905902], {2}: [0.01476074617], {3}: [0.01500158053], {4}: [0.01330029795], {5}: [0.01546412643]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))
subtraction_3 = Subtraction(A=avr_6, B=data_6)
subtraction_4 = Subtraction(A=python_8.s, B=data_7)
cluster_4 = Cluster(A=subtraction_3, B=avr_6)

# ----
# DIFFERENCE IN:
# Negative = decrease
# Positive = increase
# Average
# SD
panel_14 = Panel(subtraction)
panel_15 = Panel(cluster_3)
panel_16 = Panel(subtraction_2)

# ----
# DIFFERENCE IN:
# Negative = decrease
# Positive = increase
# Average
# SD
panel_17 = Panel(subtraction_3)
panel_18 = Panel(cluster_4)
panel_19 = Panel(subtraction_4)

# ----
# OUTPUT
# Used as input for the
# third definition described
# in Section 7.3 in report
# Complete shape as NURBS
# (before approximation)
# Single panel as NURBS
# Group of panels as NURBS
srf_3 = Surface(python_2.output)
srf_4 = Surface(python_5.nurbs)
srf_5 = Surface(python_6.nurbs)

# ==== cluster Cluster
A = ClusterInput()
B = ClusterInput()
division = Division(A=A, B=B)
multiplication = Multiplication(A=division, B=100)
roundd = RoundToDecimalPlace(NumberX=multiplication, DecimalPlace=2, RoundType=0)  # -> Rounded, Difference
concat = Concatenate(FragmentA=roundd.Rounded, FragmentB=" %")
R = ClusterOutput(concat)

# ==== cluster Cluster_2
relay = ClusterInput()
P = ClusterInput()
project = Project(Geometry=relay, Plane=P)  # -> Geometry, Transform
dist = Distance(PointA=relay, PointB=project.Geometry)
D = ClusterOutput(dist)
avr = Average(Input=dist)  # -> flatten(ArithmeticMean)
reparamnums = ReparameterizeNumbers(Numbers=avr)  # -> Reparameterized, Original
graft = GraftTree(Tree=reparamnums.Reparameterized, IncludeEmptyLists=True, IncludeNullItems=True)  # -> simplify(Tree)
T = ClusterOutput(graft)

# ==== cluster Cluster_3
relay = ClusterInput()
P = ClusterInput()
project = Project(Geometry=relay, Plane=P)  # -> Geometry, Transform
dist = Distance(PointA=relay, PointB=project.Geometry)
D = ClusterOutput(dist)
avr = Average(Input=dist)
flatten = FlattenTree(Tree=avr, Path="{0}")
reparamnums = ReparameterizeNumbers(Numbers=flatten)  # -> Reparameterized, Original
graft = GraftTree(Tree=reparamnums.Reparameterized, IncludeEmptyLists=True, IncludeNullItems=True)  # -> simplify(Tree)
match = MatchTree(Tree=graft, Guide=avr)
T = ClusterOutput(match)
