# Grasshopper definition 2019-07-09_3_Structure.gh (Grasshopper 1.0.7)
# plug-ins: Karamba, Pufferfish

# ----
# NOTE:: This definition is created as part of the master thesis 'Subdivision and approximation of free-form steel structures' of Thomas van Loon.
# 
# This definition corresponds to section 7.3 in the thesis report.
# CREATING THE GEOMETRY
# INPUT
# Final panels as untrimmed surfaces
# Output from previous definition
# (Section 7.2 in report)
srf = Surface([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])

# ----
# KARAMBA STRUCTURAL ANALYSIS
number_slider = Slider(0.4, range=0.01..0.5)

# ---- group: ULS / SLS
# False > ULS
# True > SLS
toggle = BooleanToggle(False)

# ----
# Creating the corner stiffners
# Position on top layer
# NOTE!: The domain used for the position of the corner stiffners is based on the lenght of the shortest edge in the whole shape.
# If its desired per panel, unflatten curves BEFORE length component.
# NOTE!: Number of points to rebuild curve
# NOTE!: The created pattern of corners consist out of straight lines, which do not lay on the surface. These are extended by a distance in order to make an intersection with the top- and bottom sheets
# Position on bottom layer
extend_distance = Slider(0.1, range=0..1)

# ---- group: Validation model
# Model for validation of definition
# (sample of 4 panels)
# NOTE!: Selection of 4 panels as a small model for the validation of the definition.
panel = Panel("""1
2
4
7""")
concat = Concatenate(FragmentA="{", FragmentB=panel, FragmentC="}")

# ----
# INPUT
# False = Whole geometry
# True = Partly model for validation
# Manual input parameters
# Parameter for wind direction [0.000 - 1.000]
# Starting from positive X-axis counterclockwise
# Bottom shell geometries
# Top shell geometries
# Rib geometries
# Corner geometries
toggle_2 = BooleanToggle(False)
parameter_for_wind_direction = Slider(0.4, range=0..1)
parameter_corner_location = Slider(0.2, range=0..1)
rib_height_mm = Slider(150, range=0..300)
rib_thickness_mm = Slider(3, range=0..25)
sheet_thickness_mm = Slider(2, range=0..300)
vertical_variable_load_kn_m2 = Panel("0.56")
horizontal_wind_load_kn_m2 = Panel("0.8")
dam = DataDam(DataA=toggle_2, BufferDelay=5000000, BufferMode=2)

# ---- group: Creating offset between top- and bottom layer
# Creating the top- and bottom layers
num = Number(expr("(x/1000)*0.5", rib_height_mm))
offsrf = OffsetSurface(Surface=srf, Distance=num, BothSides=True, CreateSolid=False)
item = ListItem(List=simplify(offsrf), Index=0, Wrap=True)  # -> Item, Item1

# ---- group: Construting corner stiffners top sheets
edges = BrepEdges(Brep=item.Item1)  # -> Naked, Interior, NonManifold
explode = Explode(Curve=edges.Naked, Recursive=True)  # -> reparameterize(Segments), Vertices
pshift = ShiftPaths(Data=explode.Segments, Offset=-1)
len = Length(Curve=pshift)
hilo = HighestLowestNumbers(Numbers=len)  # -> Highest, Lowest
dom = ConstructDomain(DomainStart=0, DomainEnd=expr("x*0.5", hilo.Lowest))
remap = RemapNumbers(Value=parameter_corner_location, Source=Domain(0, 1), Target=len)  # -> Mapped, Clipped
flip = FlipCurve(Curve=pshift)  # -> Curve, Flag
eval = EvaluateLength(Curve=pshift, Length=remap.Mapped, Normalized=True)  # -> Point, Tangent, Parameter
eval_2 = EvaluateLength(Curve=flip.Curve, Length=remap.Mapped, Normalized=True)  # -> Point, Tangent, Parameter
join = JoinCurves(Curves=pshift, Preserve=False)  # -> simplify(Curves)
pt = Point([eval.Point, eval_2.Point])
alongcrv = SortAlongCurve(Points=pt, Curve=join)  # -> Points, Indices
intcrv = Interpolate(Vertices=alongcrv.Points, Degree=1, Periodic=True, KnotStyle=1)  # -> Curve, Length, Domain
explode_2 = Explode(Curve=intcrv.Curve, Recursive=True)  # -> Segments, Vertices
cull = CullPattern(List=explode_2.Segments, CullPattern=[False, True])  # -> simplify(List)

# ---- group: Construting corner stiffners bottom sheets
edges_2 = BrepEdges(Brep=item.Item)  # -> Naked, Interior, NonManifold
explode_3 = Explode(Curve=edges_2.Naked, Recursive=True)  # -> reparameterize(Segments), Vertices
pshift_2 = ShiftPaths(Data=explode_3.Segments, Offset=-1)
len_2 = Length(Curve=pshift_2)
hilo_2 = HighestLowestNumbers(Numbers=len_2)  # -> Highest, Lowest
dom_2 = ConstructDomain(DomainStart=0, DomainEnd=expr("x*0.5", hilo_2.Lowest))
remap_2 = RemapNumbers(Value=parameter_corner_location, Source=Domain(0, 1), Target=len_2)  # -> Mapped, Clipped
flip_2 = FlipCurve(Curve=pshift_2)  # -> Curve, Flag
eval_3 = EvaluateLength(Curve=pshift_2, Length=remap_2.Mapped, Normalized=True)  # -> Point, Tangent, Parameter
eval_4 = EvaluateLength(Curve=flip_2.Curve, Length=remap_2.Mapped, Normalized=True)  # -> Point, Tangent, Parameter
join_2 = JoinCurves(Curves=pshift_2, Preserve=False)  # -> simplify(Curves)
pt_2 = Point([eval_3.Point, eval_4.Point])
alongcrv_2 = SortAlongCurve(Points=pt_2, Curve=join_2)  # -> Points, Indices
intcrv_2 = Interpolate(Vertices=alongcrv_2.Points, Degree=1, Periodic=True, KnotStyle=1)  # -> Curve, Length, Domain
explode_4 = Explode(Curve=intcrv_2.Curve, Recursive=True)  # -> Segments, Vertices
cull_2 = CullPattern(List=explode_4.Segments, CullPattern=[False, True])  # -> simplify(List)

# ----
cluster = Cluster_3(relay=cull_2, relay_2=cull, relay_3=extend_distance)
intersect_rebuild_and_loft = IntersectRebuildAndLoft(relay=cluster, P=Slider(6, range=0..10), srf_2=item.Item, srf=item.Item1)

# ----
# Creating the rib geometries
graft = GraftTree(Tree=pshift_2, IncludeEmptyLists=True, IncludeNullItems=True)
graft_2 = GraftTree(Tree=pshift, IncludeEmptyLists=True, IncludeNullItems=True)
loft = Loft(
    Curves=[graft, graft_2],
    Options={Adjust=False, Closed=False, LoftEnds=0, LoftSimp=0, LoftType=0, Rebuild=10, Refit=0.01})
pshift_3 = ShiftPaths(Data=loft, Offset=-1)  # -> simplify(Data)

# ----
# OUTPUT
# Top sheet
# Bottom sheet
# Rib elements
# Corner stiffners
srf_2 = Surface(item.Item)
srf_3 = Surface(item.Item1)
srf_4 = Surface(pshift_3)
brep = Brep(intersect_rebuild_and_loft)

# ---- group: Validation model (continued)
branch = TreeBranch(Tree=srf_2, Path=concat, MaintainPaths=True)
branch_2 = TreeBranch(Tree=srf_3, Path=concat, MaintainPaths=True)
branch_3 = TreeBranch(Tree=srf_4, Path=concat, MaintainPaths=True)
branch_4 = TreeBranch(Tree=brep, Path=concat, MaintainPaths=True)

# ----
filter = StreamFilter(Gate=dam, Stream0=srf_2, Stream1=branch)
filter_2 = StreamFilter(Gate=dam, Stream0=srf_3, Stream1=branch_2)
filter_3 = StreamFilter(Gate=dam, Stream0=brep, Stream1=branch_4)
filter_4 = StreamFilter(Gate=dam, Stream0=srf_4, Stream1=branch_3)

# ---- group: Assigning element properties and supports
# NOTE:: In this sections the element geometries are created. It is important that all vertices in the different meshes align, therefore the vertices of the ribs and corner stiffners are included in the meshing of the top- and bottom sheets.
# Steel sheets bottom layer
# Steel sheets top layer
# Corner stiffners
# Ribs
brep_2 = Brep(filter_3)
debrep = DeconstructBrep(Brep=filter_3)  # -> Faces, Edges, Vertices
srf_5 = Surface(filter_4)
brep_3 = Brep(filter)
brep_4 = Brep(filter_2)
pshift_4 = ShiftPaths(Data=debrep.Vertices, Offset=-1)
lng = ListLength(List=brep_2)  # -> flatten(Length)
mesh_breps = MeshBreps(
    Brep=brep_2,
    MeshResolution=1,
    EdgeRefinementFactor=0.67,
    PointReduction=False,
    SmoothingStepSize=0,
    SmoothingIterations=5)  # -> simplify(Mesh), Info
mesh_breps_2 = MeshBreps(
    Brep=srf_5,
    InclusionPoints=pshift_4,
    MeshResolution=1,
    EdgeRefinementFactor=Slider(0.2, range=0.01..0.5),
    PointReduction=False,
    SmoothingStepSize=0,
    SmoothingIterations=5)  # -> simplify(Mesh), Info
lng_2 = ListLength(List=mesh_breps_2.Mesh)  # -> flatten(Length)
lng_3 = ListLength(List=lng)  # -> flatten(Length)
lng_4 = ListLength(List=lng_2)  # -> flatten(Length)
item_2 = ListItem(List=lng, Index=0, Wrap=True)
item_3 = ListItem(List=lng_2, Index=0, Wrap=True)
series = Series(Start=0, Step=1, Count=lng_3)
series_2 = Series(Start=0, Step=1, Count=lng_4)
concat_2 = Concatenate(FragmentA="corner", FragmentB="corner", FragmentC=series)
dup = DuplicateData(Data=concat_2, Number=item_2, Order=False)
concat_3 = Concatenate(FragmentA="edges", FragmentB="_", FragmentC=series_2)
dup_2 = DuplicateData(Data=concat_3, Number=item_3, Order=False)
meshtoshell = MeshToShellKaramba(Mesh=flatten(mesh_breps.Mesh), Identifier=flatten(dup), LimitDistance_m=0.005)  # -> Element, Points, Info
meshtoshell_2 = MeshToShellKaramba(Mesh=flatten(mesh_breps_2.Mesh), Identifier=flatten(dup_2), LimitDistance_m=0.005)  # -> Element, Points, Info
mesh_breps_3 = MeshBreps(
    Brep=graft(brep_3),
    InclusionPoints=flatten([meshtoshell_2.Points, meshtoshell.Points]),
    MeshResolution=number_slider,
    EdgeRefinementFactor=0.67,
    PointReduction=False,
    SmoothingStepSize=0,
    SmoothingIterations=5)  # -> flatten(Mesh), Info
mesh_breps_4 = MeshBreps(
    Brep=graft(brep_4),
    InclusionPoints=flatten([meshtoshell_2.Points, meshtoshell.Points]),
    MeshResolution=number_slider,
    EdgeRefinementFactor=0.67,
    PointReduction=False,
    SmoothingStepSize=0,
    SmoothingIterations=5)  # -> flatten(Mesh), Info
lng_5 = ListLength(List=mesh_breps_3.Mesh)
lng_6 = ListLength(List=mesh_breps_4.Mesh)
series_3 = Series(Start=0, Step=1, Count=lng_6)
series_4 = Series(Start=0, Step=1, Count=lng_5)
concat_4 = Concatenate(FragmentA="shell_bottom", FragmentB="_", FragmentC=series_4)
concat_5 = Concatenate(FragmentA="shell_top", FragmentB="_", FragmentC=series_3)
meshtoshell_3 = MeshToShellKaramba(Mesh=mesh_breps_4.Mesh, Identifier=flatten(concat_5), LimitDistance_m=0.005)  # -> Element, Points, Info
meshtoshell_4 = MeshToShellKaramba(Mesh=mesh_breps_3.Mesh, Identifier=flatten(concat_4), LimitDistance_m=0.005)  # -> Element, Points, Info

# ----
# Initialize plane perpendicular to wind direction
bbox = BoundingBox(Content=flatten(filter_2), Plane=PlaneXY(0, 0, 0), UnionBox=True)  # -> Box, Box_2
debox = DeconstructBox(Box=bbox.Box)  # -> Plane, X, Y, Z
area = Area(Geometry=bbox.Box)  # -> Area, Centroid
larger = LargerThan(FirstNumber=debox.Y, SecondNumber=debox.X)  # -> LargerThan, OrEqualTo
xy = XYPlane(Origin=area.Centroid)
filter_5 = StreamFilter(Gate=larger.LargerThan, Stream0=debox.X, Stream1=debox.Y)
cir = Circle(Plane=xy, Radius=filter_5)
eval_5 = EvaluateCurve(Curve=reparameterize(cir), Parameter=parameter_for_wind_direction)  # -> Point, Tangent, Angle
ln = Line(StartPoint=eval_5.Point, EndPoint=xy)
pl = PlaneNormal(Origin=eval_5.Point, ZAxis=ln)

# ----
# Select mesh vertices wind load will be excerted on
pln = Plane(pl)
pt_3 = Point(meshtoshell_3.Points)
brep_5 = Brep(flatten(filter_2))
project = Project(Geometry=pt_3, Plane=pln)  # -> Geometry, Transform
join_3 = BrepJoin(Breps=brep_5)  # -> Breps, Closed
ln_2 = Line(StartPoint=pt_3, EndPoint=project.Geometry)
bcx = BrepCurve(Brep=join_3.Breps, Curve=ln_2)  # -> Curves, simplify(Points)
lng_7 = ListLength(List=bcx.Points)
eval_6 = Evaluate(F="if(x=2, False, True)", x=lng_7)
cull_3 = CullPattern(List=pt_3, CullPattern=flatten(eval_6))

# ----
# Assign point loads to selected points based on individual force areas
pln_2 = Plane(pl)
pt_4 = Point(cull_3)
project_2 = Project(Geometry=pt_4, Plane=simplify(pln_2))  # -> Geometry, Transform
hull = ConvexHull(Points=project_2.Geometry, Plane=pln_2)  # -> Hull, HullZ, Indices
boundary = BoundarySurfaces(Edges=hull.Hull)
voronoi = Voronoi(Points=project_2.Geometry, BruteForceOverride=False)
cluster_2 = Cluster(relay=voronoi, relay_2=boundary)
area_2 = Area(Geometry=cluster_2)  # -> Area, Centroid
vec2pt = Vector2Pt(PointA=project_2.Geometry, PointB=pt_4, Unitize=True)  # -> Vector, Length
multiplication = Multiplication(A=horizontal_wind_load_kn_m2, B=area_2.Area)
multiplication_2 = Multiplication(A=vec2pt.Vector, B=multiplication)

# ----
# Supports (full geometry)
# NOTE:: In this sections the supports are set. However, per design this is completely different and this section needs to be adjusted for each design.
# Sheets bottom
# Sheets top
# Supports (partly geometry
# for validation)
# Sheets bottom
# Sheets top
threshold = Slider(0.06, range=0..0.1)
pt_5 = Point(meshtoshell_3.Points)
threshold_2 = Slider(0.02, range=0..0.1)
pt_6 = Point(meshtoshell_4.Points)
pt_7 = Point(meshtoshell_4.Points)
pt_8 = Point(meshtoshell_3.Points)
pdecon = Deconstruct(Point=pt_7)  # -> XComponent, YComponent, ZComponent
pdecon_2 = Deconstruct(Point=pt_8)  # -> XComponent, YComponent, ZComponent
cullpt = CullDuplicates(Points=pt_5, Tolerance=0.1, CullMode=3)  # -> Points, Indices, Valence
cullpt_2 = CullDuplicates(Points=pt_6, Tolerance=0.1, CullMode=3)  # -> Points, Indices, Valence
smaller = SmallerThan(FirstNumber=pdecon.ZComponent, SecondNumber=threshold)  # -> SmallerThan, OrEqualTo
smaller_2 = SmallerThan(FirstNumber=pdecon_2.ZComponent, SecondNumber=threshold_2)  # -> SmallerThan, OrEqualTo
pdecon_3 = Deconstruct(Point=cullpt.Points)  # -> XComponent, YComponent, ZComponent
pdecon_4 = Deconstruct(Point=cullpt_2.Points)  # -> XComponent, YComponent, ZComponent
hilo_3 = HighestLowestNumbers(Numbers=pdecon_3.XComponent)  # -> Highest, Lowest
hilo_4 = HighestLowestNumbers(Numbers=pdecon_4.XComponent)  # -> Highest, Lowest
cull_4 = CullPattern(List=pt_7, CullPattern=smaller.OrEqualTo)
cull_5 = CullPattern(List=pt_8, CullPattern=smaller_2.OrEqualTo)
equalst = EqualityWithinTolerance(FirstNumber=pdecon_4.XComponent, SecondNumber=hilo_4.Highest, Tolerance=0.001)
cullpt_3 = CullDuplicates(Points=cull_5, Tolerance=0.1, CullMode=3)  # -> Points, Indices, Valence
equalst_2 = EqualityWithinTolerance(FirstNumber=pdecon_4.XComponent, SecondNumber=hilo_4.Lowest, Tolerance=0.001)
equalst_3 = EqualityWithinTolerance(FirstNumber=pdecon_3.XComponent, SecondNumber=hilo_3.Highest, Tolerance=0.001)
cullpt_4 = CullDuplicates(Points=cull_4, Tolerance=0.1, CullMode=3)  # -> Points, Indices, Valence
equalst_4 = EqualityWithinTolerance(FirstNumber=pdecon_3.XComponent, SecondNumber=hilo_3.Lowest, Tolerance=0.001)
cull_6 = CullPattern(List=cullpt.Points, CullPattern=equalst_3)
cull_7 = CullPattern(List=cullpt_2.Points, CullPattern=equalst)
cull_8 = CullPattern(List=cullpt_2.Points, CullPattern=equalst_2)
cull_9 = CullPattern(List=cullpt.Points, CullPattern=equalst_4)
filter_6 = StreamFilter(Gate=dam, Stream0=[cull_4, cull_5], Stream1=[cull_7, cull_8, cull_6, cull_9])
supp = SupportKaramba(PosInd=filter_6, menu=[buttons(on, on, on, off, off, off)])

# ----
# WIND LOAD VIEWER
number_slider_2 = Slider(6.09, range=0..10)
multiplication_3 = Multiplication(A=multiplication_2, B=number_slider_2)
line = LineSDL(Start=pt_4, Direction=vec2pt.Vector, Length=multiplication_3)

# ----
# Loadcase selection
# Dead weight
# NOTE:: In this section all load cases are created, with the buttons on the right the loads can individually be selected.
# Vertical variable load
# Horizontal variable load
Z = UnitZ(Factor=expr("x*-1", vertical_variable_load_kn_m2))
Z_2 = UnitZ(Factor=1)
cluster_3 = Cluster_4(A=multiplication_2, x=toggle, _0="1.0", _1="1.5")
cluster_4 = Cluster_4(A=Z_2, x=toggle, _0="1.0", _1="1.2")
cluster_5 = Cluster_4(A=Z, x=toggle, _0="1.0", _1="1.5")
toggle_3 = BooleanToggle(True)
toggle_4 = BooleanToggle(True)
loads = LoadsKaramba(
    Vector=cluster_5,
    Mesh=mesh_breps_4.Mesh,
    LCase="1",
    mode="MeshLoad -Const.",
    menu=[buttons(off, off, on), buttons(on, on)])
loads_2 = LoadsKaramba(Vector=cluster_4, LCase="0", mode="Gravity")
loads_3 = LoadsKaramba(ForceVector=cluster_3, Local=pt_4, PosInd=pt_4, LCase="2", mode="Point")
eval_7 = Evaluate(
    F="if(x=True, if(y=True, if(z=True, 0, 1), if(z=True, 2, 3)), if(y=True, if(z=True, 4, 5), if(z=True, 6, 7)))",
    x=toggle_3,
    y=toggle_4,
    z=Toggle(False))
dw = LoadKaramba(loads_2)
vv = LoadKaramba(loads)
hv = LoadKaramba(loads_3)
cluster_6 = Cluster_2(G=eval_7)  # -> flatten(s_1)
selected_loadcase = Panel(cluster_6)
filter_7 = StreamFilter(
    Gate=eval_7,
    Stream0=[dw, vv, hv],
    Stream1=[dw, vv],
    Stream2=[dw, hv],
    Stream3=dw,
    Stream4=[vv, hv],
    Stream5=vv,
    Stream6=hv)  # -> flatten(Stream)

# ---- group: Setting cross-sections and materials
# NOTE:: In this section the cross-sections and materials are set. The cross-sections can be adjusted from the input-section for the Karamba analysis.
# Cross-sections
# Materials (Steel S235)
division = Division(A=rib_thickness_mm, B=10)
division_2 = Division(A=sheet_thickness_mm, B=10)
cross_sections = CrossSectionsKaramba(
    FamilyNameOfCrossSection="DefaultCroSec",
    ElementsIdentifiers=flatten([dup_2, dup]),
    Material=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,
    Height_cm=division,
    mode="Shell - Const")
cross_sections_2 = CrossSectionsKaramba(
    FamilyNameOfCrossSection="DefaultCroSec",
    ElementsIdentifiers=flatten([concat_5, concat_4]),
    Material=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,
    Height_cm=division_2,
    mode="Shell - Const")
matselect = MaterialSelectionKaramba(ElementsIdentifiers=flatten([concat_4, concat_5, dup, dup_2]), menu=[dropdown(1), dropdown(2)])

# ---- group: Geometry to display
# Sheet elements
# Rib elements
# + corners
toggle_5 = BooleanToggle(True)
eval_8 = Evaluate(F="if(x=True, if(y=True, 2, 0), if(y=True, 1, 3))", x=toggle_5, y=Toggle(True))
eval_9 = Evaluate(F="if(x=0, \"Curved sheets\", if(x=1, \"Ribs and/or corners\", if(x=2, \"All elements\", \"No elements\")))", x=eval_8)
visible_elements = Panel(eval_9)
filter_8 = StreamFilter(Gate=eval_8, Stream0=[concat_4, concat_5], Stream1=[dup, dup_2], Stream2=[concat_4, concat_5, dup, dup_2])

# ---- group: Assembling and analysing model
# Shell view
# Converting stresses
# Converting displacements
assemble = AssembleModelKaramba(
    Elem=[meshtoshell_4.Element, meshtoshell_3.Element, meshtoshell.Element, meshtoshell_2.Element],
    Support=supp,
    Load=filter_7,
    CrossSection=[cross_sections_2, cross_sections],
    Material=matselect,
    LimitDistance_m=0.005)  # -> Model, Info, Mass_kg, CenterOfGravity
analyzethii = AnalyzeThIIKaramba3D(Model=assemble.Model, LoadCase=Slider(-1, range=-1..1), RTolerance=1e-07, MaxIterations=50, NoTensionalNII=False)  # -> CalculatedModel, MaximumDisplacement_cm, ResultingForceOfGravity_kN, ElasticEnergy_kNm; disabled
analyze = AnalyzeKaramba3D(Model=assemble.Model)  # -> CalculatedModel, MaximumDisplacement_cm, ResultingForceOfGravity_kN, ElasticEnergy_kNm; disabled
modelview = ModelViewKaramba(
    Model=analyzethii.CalculatedModel,
    LoadCaseFactorsForLinearSuperposition=1,
    IndexOfVisibleLoadcase=-1,
    ElementIdentifiersBreps=flatten(filter_8))  # -> Model, DeformedMesh, DeformedAxes, DeformedModel
shellview = ShellViewKaramba(Model=modelview.Model, IndexOfLayer=0)  # -> Model, MeshesOfRenderedShells, LegendColors, LegendTags
cull_i = CullIndex(List=shellview.LegendTags, Indices=0, Wrap=True)
cull_i_2 = CullIndex(List=shellview.LegendTags, Indices=0, Wrap=True)
multiplication_4 = Multiplication(A=cull_i, B=10)
multiplication_5 = Multiplication(A=cull_i_2, B=10)
merge = Merge(Data1="Stress [N/mm2]", Data2=multiplication_4)  # -> flatten(Result)
merge_2 = Merge(Data1="Displacement [mm]", Data2=multiplication_5)  # -> flatten(Result)
legend = Legend(Colour=shellview.LegendColors, Tags=shellview.LegendTags, LegendType=1)

# ----
# Buckling analysis
# NOTE:: Model:   Second Order model
# FromInd: First modus of Buckling to be calculated
# NModes:  Number of Buckling modes to calculate
# 
# The model should be evaluated as section 7.3 in the report.
# Converting stresses
# Converting displacements
panel_2 = Panel("1")
bmodes = BucklingModesKaramba(Model=analyzethii.CalculatedModel, FromIndex=panel_2, NumberOfModes="5", MaximumNumberOfIterations=300, Epsilon=1e-07)  # -> ModelWithBucklingModesAsLoadCaseResults, BucklingLoadFactors
panel_3 = Panel(bmodes.BucklingLoadFactors)
modelview_2 = ModelViewKaramba(
    Model=bmodes.ModelWithBucklingModesAsLoadCaseResults,
    LoadCaseFactorsForLinearSuperposition=1,
    IndexOfVisibleLoadcase=-1,
    ElementIdentifiersBreps=flatten(filter_8))  # -> Model, DeformedMesh, DeformedAxes, DeformedModel
shellview_2 = ShellViewKaramba(Model=modelview_2.Model, IndexOfLayer=0)  # -> Model, MeshesOfRenderedShells, LegendColors, LegendTags
cull_i_3 = CullIndex(List=shellview.LegendTags, Indices=0, Wrap=True)
cull_i_4 = CullIndex(List=shellview.LegendTags, Indices=0, Wrap=True)
multiplication_6 = Multiplication(A=cull_i_3, B=10)
multiplication_7 = Multiplication(A=cull_i_4, B=10)
merge_3 = Merge(Data1="Stress [N/mm2]", Data2=multiplication_6)  # -> flatten(Result)
merge_4 = Merge(Data1="Displacement [mm]", Data2=multiplication_7)  # -> flatten(Result)
legend_2 = Legend(Colour=shellview_2.LegendColors, Tags=shellview_2.LegendTags, LegendType=1)

# ----
# Toggle view and loads
selected_loadcase_2 = Panel(cluster_6)

# ----
# VALIDATING THE MODEL
# VALIDATION OF MASS (checking if double sheets are deleted)
disassemble = DisassembleMaterialKaramba(Material=matselect)  # -> Material, TypeOfMaterial, FamilyNameOfMaterial, NameOfMaterial, ElemIdentifiers, Color, YoungsModulusKNCm2Dir12, InPlaneShearModulus_kN_cm2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
area_3 = Area(Geometry=flatten([filter, filter_2]))  # -> Area, Centroid
area_4 = Area(Geometry=flatten([filter_4, filter_3]))  # -> Area, Centroid
division_3 = Division(A=rib_thickness_mm, B=1000)
division_4 = Division(A=sheet_thickness_mm, B=1000)
ma = MassAddition(Input=area_3.Area)  # -> Result, PartialResults
ma_2 = MassAddition(Input=area_4.Area)  # -> Result, PartialResults
multiplication_8 = Multiplication(A=ma.Result, B=division_4)
multiplication_9 = Multiplication(A=ma_2.Result, B=division_3)
division_5 = Division(A=analyze.ResultingForceOfGravity_kN, B=0.00981)
multiplication_10 = Multiplication(A=disassemble.SpecificWeight_kN_m3, B=multiplication_9)
multiplication_11 = Multiplication(A=disassemble.SpecificWeight_kN_m3, B=multiplication_8)
division_6 = Division(A=multiplication_10, B=0.00981)
division_7 = Division(A=multiplication_11, B=0.00981)
eval_10 = Evaluate(F="Format(\"{0:0.00 kg}\", x)", x=division_5)
addition = Addition(A=division_7, B=division_6)
total_weight_of_structure_according_to_k = Panel(eval_10)  # "Total weight of structure (according to Karamba)"
eval_11 = Evaluate(F="Format(\"{0:0.00 kg}\", x)", x=addition)
eval_12 = Evaluate(F="Format(\"{0:0.00 kg}\", x)", x=division_7)
eval_13 = Evaluate(F="Format(\"{0:0.00 kg}\", x)", x=division_6)
total_weight_of_structure = Panel(eval_11)
total_weight_of_sheets = Panel(eval_12)
total_weight_of_ribs = Panel(eval_13)

# ----
# VALIDATION OF LOADS
# Vertical projected load
# Total vertical reaction force VS Total vertical load
number_slider_3 = Slider(0, range=-1..2)
react = ReactionForcesKaramba(AnalyzedModel=modelview.Model, LoadCase=[number_slider_3, Slider(1, range=-1..2)])  # -> AnalyzedModel, ReactionForces_kN, ReactionMoments_kNm, SupportPosition, SumOfReactionForces_kN, SumOfReactionMoments_kNm
load = LoadKaramba(loads)
brep_6 = Brep(filter_2)
project_3 = Project(Geometry=brep_6, Plane=PlaneXY(0, 0, 0))  # -> Geometry, Transform
area_5 = Area(Geometry=brep_6)  # -> Area, Centroid
area_6 = Area(Geometry=project_3.Geometry)  # -> Area, Centroid
devec = DeconstructVector(Vector=react.ReactionForces_kN)  # -> XComponent, YComponent, ZComponent
division_8 = Division(A=devec.ZComponent, B=0.00981)
eval_14 = Evaluate(F="if(x=True, if(y=True, 2, 0), if(y=True, 1, 3))", x=toggle_3, y=toggle_4)
area_m2 = Panel(area_5.Area)
projected_area_m2 = Panel(area_6.Area)
ma_3 = MassAddition(Input=flatten(addition))  # -> Result, PartialResults
ma_4 = MassAddition(Input=division_8)  # -> Result, PartialResults
multiplication_12 = Multiplication(A=vertical_variable_load_kn_m2, B=1.5)
abs = Absolute(Value=ma_4.Result)
panel_4 = Panel(load)
multiplication_13 = Multiplication(A=multiplication_12, B=projected_area_m2)
division_9 = Division(A=multiplication_13, B=0.00981)
ma_5 = MassAddition(Input=flatten(division_9))  # -> Result, PartialResults
filter_9 = StreamFilter(Gate=eval_14, Stream0=ma_3.Result, Stream1=ma_5.Result, Stream2=[ma_3.Result, ma_5.Result])
ma_6 = MassAddition(Input=flatten(filter_9))  # -> Result, PartialResults
ma_7 = MassAddition(Input=flatten(abs))  # -> Result, PartialResults
total_vertical_reaction_force_kg = Panel(ma_7.Result)
total_vertical_force_kg = Panel(ma_6.Result)
resultant_force_kn = Panel(multiplication_13)

# ---- group: Difference in area between surfaces and meshes
# Total area of surfaces before and after meshing
area_7 = Area(Geometry=flatten([mesh_breps_3.Mesh, mesh_breps_4.Mesh]))  # -> Area, Centroid
area_8 = Area(Geometry=flatten([mesh_breps.Mesh, mesh_breps_2.Mesh]))  # -> Area, Centroid
ma_8 = MassAddition(Input=flatten([area_3.Area, area_4.Area]))  # -> Result, PartialResults
ma_9 = MassAddition(Input=[area_7.Area, area_8.Area])  # -> Result, PartialResults
area_of_meshes_from_surfaces_m2 = Panel(ma_9.Result)
area_of_surfaces_m2 = Panel(ma_8.Result)

# ==== cluster IntersectRebuildAndLoft
srf = ClusterInput()
srf_2 = ClusterInput()
relay = ClusterInput()
P = ClusterInput()
srf_3 = Surface(reparameterize(srf))
srf_4 = Surface(reparameterize(srf_2))
bbx = BrepBrep(BrepA=srf_3, BrepB=relay)  # -> Curves, Points
bbx_2 = BrepBrep(BrepA=srf_4, BrepB=relay)  # -> Curves, Points
rebcrv = RebuildCurve(Curve=bbx.Curves, Count=P, Degree=3, EndTangents=False)
rebcrv_2 = RebuildCurve(Curve=bbx_2.Curves, Count=P, Degree=3, EndTangents=False)
loft = Loft(
    Curves=[rebcrv_2, rebcrv],
    Options={Adjust=False, Closed=False, LoftEnds=0, LoftSimp=0, LoftType=0, Rebuild=10, Refit=0.01})
pshift = ShiftPaths(Data=loft, Offset=-1)
D = ClusterOutput(pshift)

# ==== cluster Cluster
relay = ClusterInput()
relay_2 = ClusterInput()
explode = Explode(Curve=relay, Recursive=True)  # -> Segments, simplify(Vertices)
incurve = PointInCurve(Point=explode.Vertices, Curve=relay_2)  # -> Relationship, Point
eval = Evaluate(F="if(x=2, True, False)", x=incurve.Relationship)
sort = SortList(Keys=eval)  # -> Keys, ValuesA
item = ListItem(List=sort.Keys, Index=0, Wrap=True)  # -> Item1, Item
cull = CullPattern(List=relay, CullPattern=invert(flatten(item.Item)))
srfsplit = SurfaceSplit(Surface=relay_2, Curves=simplify(graft(cull)))
area = Area(Geometry=srfsplit)  # -> Area, Centroid
sort_2 = SortList(Keys=area.Area, ValuesA=srfsplit)  # -> Keys, ValuesA
item_2 = ListItem(List=sort_2.ValuesA, Index=0, Wrap=True)  # -> flatten(Item)
index = ItemIndex(List=relay, Item=cull)
crv = Curve(item_2)
replace = ReplaceItems(List=relay, Item=crv, Indices=index, Wrap=False)
L = ClusterOutput(replace)

# ==== cluster Cluster_2
G = ClusterInput()
filter = StreamFilter(
    Gate=G,
    Stream0=["Dead weight", "Vertical variable load", "Horizontal wind load"],
    Stream1=["Dead weight", "Vertical variable load"],
    Stream2=["Dead weight", "Horizontal wind load"],
    Stream3="Dead weight",
    Stream4=["Vertical variable load", "Horizontal wind load"],
    Stream5="Vertical variable load",
    Stream6="Horizontal wind load")
s_1 = ClusterOutput(filter)

# ==== cluster Cluster_3
relay = ClusterInput()
relay_2 = ClusterInput()
eval = EvaluateCurve(Curve=reparameterize(relay_2), Parameter="0.5")  # -> Point, Tangent, Angle
eval_2 = EvaluateCurve(Curve=reparameterize(relay), Parameter="0.5")  # -> Point, Tangent, Angle
cp = ClosestPoint(Point=eval_2.Point, Cloud=eval.Point)  # -> ClosestPoint, CPIndex, Distance
item = ListItem(List=relay_2, Index=cp.CPIndex, Wrap=True)
graft = GraftTree(Tree=relay, IncludeEmptyLists=True, IncludeNullItems=True)
graft_2 = GraftTree(Tree=item, IncludeEmptyLists=True, IncludeNullItems=True)
flipselection = FlipSelection(crv_2=graft, crv=graft_2)
loft = Loft(
    Curves=[graft, flipselection],
    Options={Adjust=False, Closed=False, LoftEnds=0, LoftSimp=0, LoftType=0, Rebuild=10, Refit=0.01})
relay_3 = ClusterInput()
pshift = ShiftPaths(Data=loft, Offset=-1)
extendsrf = ExtendSurface(Surface=pshift, WestEdge=relay_3, SouthEdge=0, EastEdge=relay_3, NorthEdge=0, ExtensionType=True)
S = ClusterOutput(extendsrf)

# ==== cluster Cluster_4
x = ClusterInput()
_0 = ClusterInput()
_1 = ClusterInput()
eval = Evaluate(F="if(x=True, 0, 1)", x=x)
A = ClusterInput()
filter = StreamFilter(Gate=eval, Stream0=_0, Stream1=_1)
multiplication = Multiplication(A=A, B=filter)
R = ClusterOutput(multiplication)

# ==== cluster FlipSelection
crv = ClusterInput()
crv_2 = ClusterInput()
crv_3 = Curve(crv_2)
crv_4 = Curve(crv)
end = EndPoints(Curve=crv_4)  # -> Start, End
end_2 = EndPoints(Curve=crv_3)  # -> Start, End
dist = Distance(PointA=end_2.Start, PointB=end.Start)
hilo = HighestLowestNumbers(Numbers=flatten(dist))  # -> Highest, Lowest
subtraction = Subtraction(A=dist, B=hilo.Highest)
subtraction_2 = Subtraction(A=hilo.Lowest, B=dist)
smaller = SmallerThan(FirstNumber=subtraction, SecondNumber=subtraction_2)  # -> SmallerThan, OrEqualTo
cull = CullPattern(List=crv_4, CullPattern=invert(smaller.SmallerThan))
cull_2 = CullPattern(List=crv_4, CullPattern=smaller.SmallerThan)
flip = FlipCurve(Curve=cull, Guide=crv_3)  # -> Curve, Flag
merge = Merge(Data1=cull_2, Data2=flip.Curve)
R = ClusterOutput(merge)
